# Grasshopper definition GrasshopperImplmentation.gh (Grasshopper 1.0.7)

panel = Panel("TODO: ")
srf = Surface(<surface referenced from the Rhino model>)
cluster = Cluster_7(S=srf, C=srf)  # -> num_3, num_4

minopeningwidth = Slider(0.8, range=0.4..2)
marge_latérale = Slider(0.3, range=0.1..2)

minopeningheight = Slider(0.6, range=0.4..2)
margeinf = Slider(0.7, range=0..2)
margesup = Slider(1.1, range=0..2)

largeurtuile = Slider(0.3, range=0.2..1)
hauteurtuile = Slider(0.3, range=0.2..2)
c_script = CSharpScript(x=largeurtuile)  # -> A
# ---------- c_script: C# usings ----------
using System.Threading;
# ---------- c_script: C# ----------
    var now = DateTime.Now;
    while (DateTime.Now.Subtract(now).Milliseconds < 100)
    {}
    A = x;
# ---------- end c_script ----------
c_script_2 = CSharpScript(x=hauteurtuile)  # -> A; same code as c_script
taille_x = Number(c_script)
taille_y = Number(c_script_2)

# ----
# Ouvertures
number_slider = Slider(0.4, range=0..1)
colonnes = Slider(2, range=1..5)
nombre_de_portes = Slider(1, range=0..10)
rangées = Slider(2, range=0..10)
variation_baies = Slider(53, range=0..100)
cluster_2 = Cluster_6(
    tailley=taille_y,
    minopeningheight=minopeningheight,
    margeinf=margeinf,
    margesup=margesup,
    randomness=number_slider,
    row=rangées,
    N=colonnes,
    A=cluster.num_4,
    A_2=variation_baies,
    N_2=1,
    B=nombre_de_portes)  # -> R, int_6
cluster_3 = Cluster_4(
    A_2=minopeningwidth,
    num=marge_latérale,
    randomness=number_slider,
    int=colonnes,
    N=rangées,
    A=cluster.num_3,
    A_3=variation_baies,
    num_2=taille_x)  # -> R, int_5
bnd = Bounds(Numbers=cluster_3.R)
bnd_2 = Bounds(Numbers=cluster_2.R)
dom² = ConstructDomain²(DomainU=bnd, DomainV=bnd_2)
subsrf = Isotrim(Surface=reparameterize(srf), Domain=dom²)

number_slider_2 = Slider(3, range=1..10)
number_slider_3 = Slider(3, range=1..10)

clean = CleanTree(RemoveNulls=True, RemoveInvalid=True, RemoveEmpty=True, Tree=subsrf)

# ----
# Trame et Parement
variation_façade = Slider(9, range=0..20)
sdivide = DivideSurface(Surface=srf, UCount=expr("x*2", cluster_3.int_5), VCount=expr("x*2", cluster_2.int_6))  # -> Points, Normals, Parameters
rec = Rectangle(clean)
incurves = PointInCurves(Point=sdivide.Points, Curves=flatten(rec))  # -> Relationship, Index, Point
sift = SiftPattern(List=sdivide.Points, SiftPattern=incurves.Relationship)  # -> Output0, Output1, Output2
cluster_4 = Cluster_8(B=rec, P=sift.Output1)
c_script_3 = CSharpScript(
    iPoints=sdivide.Points,
    ExPoints=sift.Output2,
    Openingpts=cluster_4,
    MaxX=number_slider_2,
    MaxY=number_slider_3,
    seed=variation_façade)  # -> out, A, B; inputs iPoints: tree of Point3d, ExPoints: tree of Point3d, Openingpts: tree of Point3d, MaxX: Int32, MaxY: Int32, seed: Int32
# ---------- c_script_3: C# usings ----------
using System.Linq;
# ---------- c_script_3: C# ----------
    List<Rectangle3d> claddingrects = new List<Rectangle3d>();
    _seed = seed;
    _maxY = MaxX;
    _maxX = MaxY;

    List < List < Point3d >> pts = new List<List<Point3d>>();
    List<List<Point3d>> xpts = new List<List<Point3d>>();
    List<List<Point3d>> openingpts = new List<List<Point3d>>();
    for (int i = 0;i < iPoints.BranchCount ; i++)
    {
      pts.Add(iPoints.Branch(i));
      xpts.Add(ExPoints.Branch(i));
      openingpts.Add(Openingpts.Branch(i));
    }
    Cladding(pts, xpts, openingpts, Nul, _seed, _maxX, _maxY, out claddingrects);
    A = claddingrects;
    //B = b;
  }
  private static List<int> _indexList = new List<int>();
  private static int _seed;
  private static int _maxX;
  private static int _maxY;
  public static List<Point3d> b;
  public static Plane Pln = new Plane();
  public static Point3d Nul = new Point3d(0, 0, 0);
  public static void Cladding(List < List < Point3d >> iPoints, List<List<Point3d>> exPoints, List<List < Point3d >> openingPts, Point3d nullPoint, int seed, int maxX, int maxY, out List<Rectangle3d> claddingRects)
  {
    _indexList.Clear();
    _maxX = maxX;
    List<List<Point3d>> pts = new List<List<Point3d>>();
    pts.AddRange(iPoints);
    b = new List<Point3d>();
    List<List<Point3d>> xPts = new List<List<Point3d>>();
    xPts.AddRange(exPoints);
    Nul = nullPoint;
    _seed = seed;
    for (var i = 0; i < iPoints.Count - 1; i++) //Pts
    {
      for (var j = 0; j < iPoints[i].Count - 1;j++)
      {
        if ((exPoints[i][j].Equals(Nul)))// | )
        {
          if (((i % 2) == 0) && ((j % 2) == 0))
          {
            _indexList.Add((i * 1000 + j));
            b.Add(iPoints[i][j]);
          }
        }
        if ((openingPts[i][j] != Nul))// | )
        {
          if (((i % 2) == 0) && ((j % 2) == 0))
          {
            if (_indexList.Contains(i * 1000 + j))
              _indexList.Remove((i * 1000 + j));
          }
        }
      }
    }

    List<Rectangle3d> oRect = new List<Rectangle3d>();
    oRect.Clear();
    _maxY = maxY;
    for (int j = maxX, i = maxY, m = i * j; m > 1; )
    {
      Rectangle(i * 2, j * 2, ref pts, ref xPts, ref oRect, ref _indexList);
      if (i > 1)
        Rectangle((i - 1) * 2, j * 2, ref pts, ref xPts, ref oRect, ref _indexList);
      if (j > 1)
        Rectangle(i * 2, (j - 1) * 2, ref pts, ref xPts, ref oRect, ref _indexList);
      if (i > 1)
        --i;
      if (j > 1)
        --j;
      m = i * j;
    }
    foreach (var id in _indexList)
    {
      int id1 = id / 1000;
      int id2 = id - id1 * 1000;
      Plane rPlane = new Plane(pts[id1 + 2][id2], pts[id1][id2], pts[id1 + 2][id2 + 2]);
      var rec = new Rectangle3d(rPlane, pts[id1][id2], pts[id1 + 2][id2 + 2]);
      oRect.Add(rec);
    }
    claddingRects = oRect;
  }
  private static Rectangle3d CheckRectangle(int x, int y, int[] index, List<List < Point3d >> pts, ref List<List<Point3d>> xPts, ref int iter, ref List<int> indexList, ref List<int> tempList)
  {
    var insidePtsIdx = InsidePts(x, y, index);
    var perimeterIdx = PerimeterPts(x, y, index);
    bool test = false;
    Rectangle3d rect = new Rectangle3d();
    foreach (List<int> idx in perimeterIdx)
    {
      Point3d inPt = xPts[idx[0]][idx[1]];
      test = !(inPt.Equals(Nul));
      if (!test) continue;
      foreach (var removeId in from idx2 in perimeterIdx where idx2[0] % 2 == 0 && idx2[1] % 2 == 0 select idx2[0] * 1000 + idx2[1])
      {
        if (tempList.Contains(removeId))
        {tempList.Remove(removeId);}
      }
      break;
    }
    if (!test)
    {
      foreach (List<int> idx in insidePtsIdx)
      {
        var inPt = xPts[idx[0]][idx[1]];
        test = !(inPt.Equals(Nul));
        if (test)
        {
          if (tempList.Contains(idx[0] * 1000 + idx[1]))
            tempList.Remove(idx[0] * 1000 + idx[1]);
          break;
        }
      }
    }
    if (test)
    {
      iter++;
    }
    else
    {
      Point3d cptA = pts[index[0]][index[1]];
      Point3d cptB = pts[(index[0] + x)][(index[1] + y)];
      var cptC = pts[index[0]][index[1] + y];
      var plane = new Plane(cptC, cptA, cptB);
      if (cptA != cptB)
      {
        Rectangle3d r = new Rectangle3d(plane, cptA, cptB);
        rect = r;
      }
      for (int i = 1; i < (x) ;i++)//Left column
      {
        List<int> idx = new List<int>
          {
            index[0] + i,
            index[1]
            };
        if ((idx[0] % 2 == 0) && (idx[1] % 2 == 0))
        {
          indexList.Remove(idx[0] * 1000 + idx[1]);
          tempList.Remove(idx[0] * 1000 + idx[1]);

        }
      }
      for (int i = 1; i < (y) ;i++)//Bottom Row
      {
        List<int> idx = new List<int>
          {
            index[0],
            index[1] + i
            };
        if ((idx[0] % 2 == 0) && (idx[1] % 2 == 0))
        {
          indexList.Remove(idx[0] * 1000 + idx[1]);
          tempList.Remove(idx[0] * 1000 + idx[1]);

        }
      }
      foreach (List<int> idx in insidePtsIdx)
      {
        if ((idx[0] % 2 == 0) && (idx[1] % 2 == 0))
        {
          indexList.Remove(idx[0] * 1000 + idx[1]);
          tempList.Remove(idx[0] * 1000 + idx[1]);
        }
        xPts[idx[0]][idx[1]] = pts[idx[0]][idx[1]];
      }
    }
    return rect;
  }
  private static List<List<int>> InsidePts(int x, int y, IReadOnlyList<int> index)
  {
    List<List<int>> insidePtsIndex = new List<List<int>>();
    for (int i = 1; i < x;i++)
    {

      for (int j = 1;j < y;j++)
      {

        List<int> idx = new List<int>
          {
            index[0] + i,
            index[1] + j
            };
        insidePtsIndex.Add(idx);
      }
    }
    return insidePtsIndex;
  }
  private static List<List<int>> PerimeterPts(int x, int y, IReadOnlyList<int> index)
  {
    List<List<int>> insidePointsIndex = new List<List<int>>();
    for (var i = 0; i < (x + 1) ;i++) //left column
    {
      List<int> idx = new List<int>
        {
          index[0] + i,
          index[1]
          };
      insidePointsIndex.Add(idx);
    }
    for (int i = 0; i < (x + 1);i++) //right column
    {
      List<int> idx = new List<int>
        {
          index[0] + i,
          index[1] + y
          };
      insidePointsIndex.Add(idx);
    }
    for (var i = 1; i < y;i++)  // Bottom row
    {
      List<int> idx = new List<int>
        {
          index[0],
          index[1] + i
          };
      insidePointsIndex.Add(idx);
    }
    for (var i = 1; i < y ;i++) // Top row
    {
      List<int> idx = new List<int>
        {
          index[0] + x,
          index[1] + i
          };
      insidePointsIndex.Add(idx);
    }

    return insidePointsIndex;
  }
  private static void Rectangle (int i, int j, ref List<List<Point3d>> pts, ref List<List<Point3d>> xPts, ref List<Rectangle3d> oRect, ref List<int> indexList)
  {
    int iteration = 0;
    List<int> tempList = new List<int>();
    var x = pts[0].Count;
    var y = pts.Count;
    tempList.AddRange(indexList);
    var rand = new Random(_seed);
    int listLength = tempList.Count;
    while ((listLength > i * j * 2))
    {
      int idx = rand.Next(((y - i) / 2) + 1) * 2;
      int idy = rand.Next(((x - j) / 2) + 1) * 2;
      var temp = (idx * 1000) + idy;
      if (tempList.Contains(temp))
        tempList.Remove(temp);
      int id1 = idx;
      int id2 = idy;
      int[] index = {id1,id2};
      Rectangle3d rect = CheckRectangle(i, j, index, pts, ref xPts, ref iteration, ref indexList, ref tempList);
      if (rect.Height > 0)
      {
        indexList.Remove(temp);
        /*for (int _idx = idx - i + 2;_idx < idx - 2;_idx += 2)//Removing points to the left that will be unfit for this size
        {
          for (int _idy = idy - j + 2; _idy < idy + j - 2;_idy += 2)
          {
            var tid = (_idx * 1000) + _idy;
            if (tempList.Contains(tid))
            {
              tempList.Remove(tid);
            }
          }
        }

        for (int _idx = idx;_idx < idx + i - 2;_idx += 2)//Removing points underneath that will be unfit for this size
        {
          for (int _idy = idy - j + 2; _idy < idy - 2;_idy += 2)
          {
            var tid = (_idx * 1000) + _idy;
            if (tempList.Contains(tid))
            {
              tempList.Remove(tid);
            }
          }
        }*/
        //TODO maybe remove points from temp list that cant be in: -i left and -j under
        oRect.Add(rect);
      }
      _seed++;
      listLength = tempList.Count;
    }
# ---------- end c_script_3 ----------

rec_2 = Rectangle(clean)
multiplication = Multiplication(A="5", B="0.001")
cluster_5 = Cluster_3(C=c_script_3.A, num=multiplication)  # -> M, R

variation_couleur = Slider(0, range=0..9)
trim = TrimTree(Tree=cluster_5.M, Depth=1)
cluster_6 = Cluster(
    d1=ColourSwatch(SwatchColor=RGB(178, 131, 107)),
    d2=ColourSwatch(SwatchColor=RGB(222, 170, 131)),
    L=trim,
    S=variation_couleur)  # -> R, D

range = Range(Domain=cluster.num_4, Steps=rangées)
pt = ConstructPoint(XCoordinate=0, YCoordinate=0, ZCoordinate=range)
baies = WindowDoorGen(iCrv=rec_2, projectionPlane=pt, maxWidth="1500")  # -> out, Script, A, Doors, Doorframes, Windows, Windowframes, Glass; inputs iCrv: tree of Rectangle3d, refPt: tree of Point3d, projectionPlane: list of Plane, maxWidth: Double
# ---------- baies: C# usings ----------
using System.Linq;
using System.Linq.Expressions;
using Rhino.Geometry.Collections;
# ---------- baies: C# ----------
    UnitConverter();
    doors.Clear();
    innerframecrv.Clear();
    windows.Clear();
    doorframes.Clear();
    borderCurveList.Clear();
    maxDoorWidth = maxWidth * unitConverter;
    windowFrames.Clear();
    glass.Clear();
    List<double> levelHeight = new List<double>();
    foreach (var plane in projectionPlane)
    {
      double planeHeight = plane.OriginZ;
      levelHeight.Add(planeHeight);
    }

    levelHeight.Sort();
    //unitConverter = 1;

    DataTree<Rectangle3d> sortedRects = new DataTree<Rectangle3d>();
    TreeIteration(iCrv, levelHeight, sortedRects);

    //A = Rhino.RhinoDoc.ActiveDoc.ModelUnitSystem.GetHashCode();
    A = unitConverter;
    Doors = doors;
    Doorframes = doorframes;
    Windows = windows;
    Windowframes = windowFrames;
    Glass = glass;
    //Clear trees

  }

  private static void TreeIteration(DataTree<Rectangle3d> iCrv, List<double> levelHeight, DataTree<Rectangle3d> sortedRects)
  {
    for (int i = 0; i < iCrv.BranchCount; i++)
    {
      var ghPaths = GhPaths(iCrv, levelHeight, i);
      BranchIteration(iCrv, i, levelHeight, sortedRects, ghPaths);
    }
  }

  private static void BranchIteration(DataTree<Rectangle3d> iCrv, int i, List<double> levelHeight, DataTree<Rectangle3d> sortedRects, List<GH_Path> ghPaths)
  {
    foreach (Rectangle3d crv in iCrv.Branch(i))
    {
      double rectCenterZ = crv.Center.Z;
      LevelIteration(levelHeight, rectCenterZ, crv, sortedRects, ghPaths);
    }
  }

  private static void LevelIteration(List<double> levelHeight, double rectCenterZ, Rectangle3d crv,
    DataTree<Rectangle3d> sortedRects, List<GH_Path> ghPaths)
  {
    for (int k = 1; k < levelHeight.Count; k++)
    {
      if (LevelSeparation(levelHeight, rectCenterZ, crv, sortedRects, ghPaths, k)) break;
    }
  }

  private static bool LevelSeparation(List<double> levelHeight, double rectCenterZ, Rectangle3d crv, DataTree<Rectangle3d> sortedRects,
    List<GH_Path> ghPaths, int k)
  {
    if (levelHeight[k] > rectCenterZ)
    {
      WindowDoorSeparation(crv, levelHeight, k, sortedRects, ghPaths);
      return true;
    }

    return false;
  }

  private static void WindowDoorSeparation(Rectangle3d crv, List<double> levelHeight, int k,
    DataTree<Rectangle3d> sortedRects, List<GH_Path> ghPaths)
  {

    if (crv.BoundingBox.Min.Z > levelHeight[k - 1] + 20 * unitConverter)
    {
      Window(crv, k, sortedRects, ghPaths);
    }
    else
    {
      Door(crv, k, sortedRects, ghPaths);
    }
  }

  private static void Door(Rectangle3d crv, int k, DataTree<Rectangle3d> sortedRects, List<GH_Path> ghPaths)
  {
    GH_Path doorpath = ghPaths[k - 1].AppendElement(1);
    sortedRects.Add(crv, doorpath);
    List<Rectangle3d> doorBoundaries = new List<Rectangle3d>();
    RectReorientation(ref crv);
    var borderSurfaces = BorderSurfaces(crv, 50, 70);
    foreach (var borderSurface in borderSurfaces)
    {
      doorframes.Add(borderSurface, doorpath);

    }

    List<bool> split = new List<bool>();
    RectSplit(crv, doorBoundaries, split);
    for (var index = 0; index < doorBoundaries.Count; index++)
    {
      Rectangle3d doorcrv = doorBoundaries[index];
      List<Brep> portes;
      Surface vitrage;
      //Brep doorFrame;


      PorteInd(doorcrv, split[index], 50, 0, 50, 800, 50, out portes, out vitrage);
      foreach (var porte in portes)
      {
        doors.Add(porte, doorpath);
      }
      glass.Add(vitrage, doorpath);

    }
    //Porte(crv, out cadre, out portes, out vitrage, out doorCrv);
  }

  private static void Window(Rectangle3d crv, int k, DataTree<Rectangle3d> sortedRects, List<GH_Path> ghPaths)
  {
    GH_Path windowpath = ghPaths[k - 1].AppendElement(0);
    sortedRects.Add(crv, windowpath);
    //List<Rectangle3d> doorBoundaries = new List<Rectangle3d>();
    RectReorientation(ref crv);

    Rectangle3d doorcrv = crv;
    List<Brep> fenetres;
    Surface vitrage;
    List<Brep> windowFrame;
    Surface dumpSurface;
    PorteInd(doorcrv, false, 0, 0, 80, 80, 80, out windowFrame, out dumpSurface);
    PorteInd(doorcrv, false, 80, 80, 50, 50, 50, out fenetres, out vitrage);
    foreach (var fenetre in fenetres)
    {
      windows.Add(fenetre, windowpath);
    }
    glass.Add(vitrage, windowpath);
    foreach (var windowframe in windowFrame)
    {
      windowFrames.Add(windowframe, windowpath);
    }



  }
  private static List<GH_Path> GhPaths(DataTree<Rectangle3d> iCrv, List<double> levelHeight, int i)
  {
    List<GH_Path> ghPaths = new List<GH_Path>();
    for (int j = 0; j < levelHeight.Count; j++)
    {
      ghPaths.Add(iCrv.Paths[i].AppendElement(j));
    }

    return ghPaths;
  }
  private static void UnitConverter()
  {
    var unitSystem = Rhino.RhinoDoc.ActiveDoc.ModelUnitSystem;
    var unitSystemHashCode = unitSystem.GetHashCode();
    switch (unitSystemHashCode)
    {
      case 2:
        unitConverter = 1;
        break;
      case 3:
        unitConverter = 0.1;
        break;
      case 4:
        unitConverter = 0.001;
        break;
    }

  }
  private static void PorteInd(Rectangle3d doorcrv, bool split, double a, double b, double c, double d, double thickness, out List<Brep> porte, out Surface vitrage)
  {
    double e = a;
    if (split)
    {
      e = 0;
    }
    var outerFrame = OffsetRectangle(doorcrv, a, b, e);
    var innerFrame = OffsetRectangle(outerFrame, c, d, c);
    vitrage = new PlaneSurface(innerFrame.Plane, innerFrame.X, innerFrame.Y);

    var door = BrepOffset(outerFrame, innerFrame, thickness);

    porte = door;
    //borderCurveList.Add(borderCurve[0].ToNurbsCurve());
  }

  private static List<Brep> BorderSurfaces (Rectangle3d doorcrv, double a, double c)
  {
    List<Line> borderCurve = Border(doorcrv);
    var outerFrame = OffsetRectangle(doorcrv, a, 0, a);
    List<Line> innerBorderCurve = Border(outerFrame);
    List<Brep> borderSurfaces = new List<Brep>();
    for (var index = 0; index < borderCurve.Count; index++)
    {
      var outerLine = borderCurve[index].ToNurbsCurve();
      var innerLine = innerBorderCurve[index].ToNurbsCurve();
      Surface borderSurface = NurbsSurface.CreateRuledSurface(outerLine, innerLine);
      Brep borderBrep = Brep.CreateFromOffsetFace(borderSurface.ToBrep().Faces[0], c * unitConverter, 0.1 * unitConverter, true, true);
      borderSurfaces.Add(borderBrep);
    }

    return borderSurfaces;
  }

  private static List<Brep> BrepOffset(Rectangle3d outerFrame, Rectangle3d innerFrame, double a)
  {
    var outerFramelines = outerFrame.ToPolyline().GetSegments();
    var innerFramelines = innerFrame.ToPolyline().GetSegments();
    List<Brep> doorList = new List<Brep>();
    for (int i = 0; i < outerFramelines.Length; i++)
    {
      var doorBorder = NurbsSurface.CreateRuledSurface(outerFramelines[i].ToNurbsCurve(), innerFramelines[i].ToNurbsCurve()).ToBrep();
      Brep door = Brep.CreateFromOffsetFace(doorBorder.Faces[0], a * unitConverter, 0.1, true, true);
      doorList.Add(door);
    }
    return doorList;
  }

  private static List<Line> Border(Rectangle3d doorcrv)
  {
    var polyline = doorcrv.ToPolyline();
    var exploded = polyline.GetSegments();
    List<Line> border = new List<Line>();
    foreach (var line in exploded)
    {
      var mid = (line.From + line.To) / 2;
      if (mid.Z > polyline.BoundingBox.Min.Z + 5 * unitConverter)
      {
        border.Add(line);
      }
    }

    //border.ToNurbsCurve();
    return border;
  }

  private static Rectangle3d OffsetRectangle(Rectangle3d doorcrv, double a, double b, double c)
  {
    Interval intervalX = new Interval(doorcrv.X.Min + a * unitConverter, doorcrv.X.Max - c * unitConverter);
    Interval intervalY = new Interval(doorcrv.Y.Min + b * unitConverter, doorcrv.Y.Max - a * unitConverter);
    Rectangle3d offsetRectangle = new Rectangle3d(doorcrv.Plane, intervalX, intervalY);
    return offsetRectangle;
  }

  private static void RectReorientation(ref Rectangle3d crv)
  {
    Interval intervalX;
    Interval intervalY;
    Plane plane;
    RectOrientation(crv, out intervalX, out intervalY, out plane);
    //intervalY.Swap();
    crv = new Rectangle3d(plane, intervalX, intervalY);
  }

  private static void RectSplit(Rectangle3d crv, List<Rectangle3d> doorBoundaries, List<bool>split)
  {
    if (crv.Width > maxDoorWidth)
    {
      var doorBoundary1 = new Rectangle3d(crv.Plane, new Interval(crv.X.T0, crv.X.Mid), new Interval(crv.Y));
      doorBoundaries.Add(doorBoundary1);
      split.Add(true);
      var xDirection = crv.Plane.XAxis;
      xDirection.Reverse();
      var plane = new Plane(crv.Plane.Origin, xDirection, crv.Plane.YAxis);
      //plane.
      var doorBoundary2 = new Rectangle3d(plane, new Interval(-crv.X.Mid, -crv.X.T1), new Interval(crv.Y));
      doorBoundaries.Add(doorBoundary2);
      split.Add(true);
      return;
    }
    doorBoundaries.Add(crv);
    split.Add(false);
  }
  private static void RectOrientation(Rectangle3d crv, out Interval intervalX, out Interval intervalY, out Plane plane)
  {
    //Plane plane;
    if (crv.Plane.YAxis.IsParallelTo(Vector3d.ZAxis, Math.PI / 4) == 1)
    {
      intervalX = new Interval(crv.X);
      intervalY = new Interval(crv.Y);
      plane = crv.Plane;
    }
    else
    {
      intervalX = new Interval(crv.Y);
      intervalY = new Interval(crv.X);
      plane = crv.Plane;
      plane.Rotate(Math.PI / 2, plane.ZAxis);
      var testorient = plane.YAxis;
      testorient.Unitize();
      //if (testorient.Z == -1)
      //intervalY.Swap();


    }
# ---------- baies: C# additional code ----------
  public static double unitConverter;
  public static List<Rectangle3d> innerframecrv = new List<Rectangle3d>();
  public static double maxDoorWidth;
  public static DataTree<Surface> glass = new DataTree<Surface>();
  public static DataTree<Brep> windows = new DataTree<Brep>();
  public static DataTree<Brep> doors = new DataTree<Brep>();
  public static DataTree<Brep> doorframes = new DataTree<Brep>();
  public static List<Curve> borderCurveList = new List<Curve>();
  public static DataTree<Brep> windowFrames = new DataTree<Brep>();
# ---------- end baies ----------

preview = CustomPreview(Geometry=cluster_6.R, Material=cluster_6.D)
preview_2 = CustomPreview(
    Geometry=[baies.Doors, baies.Doorframes, baies.Windowframes, baies.Windows],
    Material=ColourSwatch(SwatchColor=RGB(168, 108, 77)))
brep = Brep(srf)
objdet = ObjectDetails(Object=brep)  # -> Referenced, Available, Name, Layer, Colour, Guid
concat = Concatenate(FragmentA="1.", FragmentB=objdet.Name)
c_script_4 = CSharpScript(
    TileXSize=taille_x,
    TileYSize=taille_y,
    variability=number_slider,
    columns=colonnes,
    rows=rangées,
    MaxX=number_slider_2,
    MaxY=number_slider_3,
    seed=variation_façade,
    SeedB=variation_baies,
    MargeX=marge_latérale,
    UpperMargin=margesup,
    LowerMargin=margeinf,
    MinOpeningHeight=minopeningheight,
    MinOpeningWidth=minopeningwidth,
    DoorNumber=nombre_de_portes,
    Name=concat)  # -> out, A; inputs TileXSize: Double, TileYSize: Double, variability: Double, columns: Double, rows: Double, MaxX: Double, MaxY: Double, seed: Double, SeedB: Double, MargeX: Double, UpperMargin: Double, LowerMargin: Double, MinOpeningHeight: Double, MinOpeningWidth: Double, DoorNumber: Double, Name: String
# ---------- c_script_4: C# usings ----------
using System.IO;
# ---------- c_script_4: C# ----------
    if (Name != _oldName)
      _oldParameters.Clear();
    if (Name != null)
    {
      var rhinoPath = RhinoDoc.ActiveDoc.Path;
      var rhinoName = RhinoDoc.ActiveDoc.Name;
      rhinoPath = rhinoPath.TrimEnd(rhinoName.ToCharArray());
      //rhinoName = rhinoName.TrimEnd(".3dm".ToCharArray());
      rhinoName = rhinoName.Substring(0, rhinoName.Length - 4);
      //RhinoApp.WriteLine(rhinoPath);
      rhinoPath += rhinoName + ".csv";
      if (!File.Exists(rhinoPath))
      {
        string headers = "Time;" + "Object;" + "TileXSize;" + "TileYSize;" + "Variability;" + "Columns;" + "Rows;" +
          "MultipleX;" + "MultipleY;" + "CladdingSeed;" + "OpeningSeed;" + "MargeX;" + "UpperMargin;" +
          "LowerMargin;" + "MinOpeningHeight;" + "MinOpeningWidth;" + "DoorNumber;" + "\n";
        File.AppendAllText(rhinoPath, headers);


      }
      var now = System.DateTime.Now;
      var test = now.Hour + ":" + now.Minute + ":" + now.Second + ":" + now.Millisecond + ";";

      List<double> parameters = new List<double>
        {
          TileXSize, TileYSize, _variability, _columns, _rows, MaxX, MaxY, _seed, SeedB, MargeX, UpperMargin, LowerMargin,
          MinOpeningHeight, MinOpeningWidth,DoorNumber
          };
      if (_oldParameters.Count > 0)
      {
        int check = 1;
        for (var i = 0; i < parameters.Count; i++)
        {
          if (Math.Abs(parameters[i] - _oldParameters[i]) > 0.01)
            check = 0;
        }
        if (check == 1)
        {
          A = "skipped";
          return;
        }
      }

      test += Name + ";";
      _oldParameters.Clear();
      foreach (var parameter in parameters)
      {
        _oldParameters.Add(parameter);
        test += (parameter.ToString()) + ";";
      }
      test += "\n";
      _oldName = Name;
      File.AppendAllText(rhinoPath, test);
      A = "written";
    }
# ---------- c_script_4: C# additional code ----------
  private static List<double> _oldParameters = new List<double>();
  private static string _oldName = "";
# ---------- end c_script_4 ----------
panel_2 = Panel(c_script_4.A)

# ==== cluster Cluster
L = ClusterInput()
S = ClusterInput()
jitter = Jitter(List=L, Jitter=1, Seed=S)  # -> Values, Indices
python = GhPythonScript(x=jitter.Values)  # -> out, a, b, c, d; inputs x: list of Curve; disabled
# ---------- python: Python ----------
__author__ = "Xavier"
__version__ = "2020.03.22"

import rhinoscriptsyntax as rs
import ghpythonlib.components as ghpc

i=1

a=x
a=ghpc.Dispatch(a,[True,False])
#e,f=ghpc.Dispatch(a,[True,False])
#c,d=ghpc.Dispatch(f,[True,False])
#a,b=ghpc.Dispatch(e,[True,False])
def disp(a,l,i):
    if i==l:
        return a
    else:
        b=[]
        for z in range(i):
            print(type(z))
            c,d=ghpc.Dispatch(a[z],[True,False])
            b.append(c)
            b.append(d)
            #print(type(d))
            #b.insert(d,int(2*z))
            #b.insert(e,2*z+1)
        a=b
        i=i+1
        return disp(a,l,i)
a=disp(a,2,i)
#    b=ghpc.Dispatch(b,[True,False])
#    for c in b:
#        c=ghpc.Dispatch(c,[True,False])
# ---------- end python ----------
dispatch = Dispatch(List=jitter.Values, DispatchPattern=[True, False])  # -> ListA, ListB
jitter_2 = Jitter(List=dispatch.ListB, Jitter=1, Seed=2)  # -> Values, Indices
jitter_3 = Jitter(List=dispatch.ListA, Jitter=1, Seed=2)  # -> Values, Indices
d1 = ClusterInput()
d2 = ClusterInput()
dispatch_2 = Dispatch(List=jitter_2.Values, DispatchPattern=[True, False])  # -> ListA, ListB
dispatch_3 = Dispatch(List=jitter_3.Values, DispatchPattern=[True, False])  # -> ListA, ListB
range = Range(Domain=Domain(0, 1), Steps=Slider(7, range=0..10))
merge = Merge(Data1=d1, Data2=d2)
dispatch_4 = Dispatch(List=dispatch_3.ListB, DispatchPattern=[True, False])  # -> ListA, ListB
dispatch_5 = Dispatch(List=dispatch_3.ListA, DispatchPattern=[True, False])  # -> ListA, ListB
dispatch_6 = Dispatch(List=dispatch_2.ListB, DispatchPattern=[True, False])  # -> ListA, ListB
dispatch_7 = Dispatch(List=dispatch_2.ListA, DispatchPattern=[True, False])  # -> ListA, ListB
twnthrucols = TweenThroughColors(Colors=merge, Factor=range, Normalized=True, Equalized=False, Weighted=False, Degree=3, InterpolationType=0, Alpha=True)
entwine = Entwine(
    Branch00=dispatch_5.ListA,
    Branch01=dispatch_5.ListB,
    Branch02=dispatch_4.ListA,
    Branch03=dispatch_4.ListB,
    Branch04=dispatch_7.ListA,
    Branch05=dispatch_7.ListB,
    Branch06=dispatch_6.ListA,
    Branch07=dispatch_6.ListB,
    FlattenInputs=True)
pshift = ShiftPaths(Data=twnthrucols, Offset="-2")  # -> graft(Data)
srf = Surface()
R = ClusterOutput(entwine)
D = ClusterOutput(pshift)

# ==== cluster Cluster_3
num = ClusterInput()
C = ClusterInput()
num_2 = Number(num)
flip = FlipCurve(Curve=C)  # -> Curve, Flag
drec = DeconstuctRectangle(Rectangle=flip.Curve)  # -> BasePlane, XInterval, YInterval
deplane = DeconstructPlane(Plane=drec.BasePlane)  # -> Origin, XAxis, YAxis, ZAxis
cluster = Cluster_2(I=drec.XInterval, num=num_2)
cluster_2 = Cluster_2(I=drec.YInterval, num=num_2)
amp = Amplitude(Vector=deplane.ZAxis, Amplitude="-0.020")
rectangle = Rectangle(Plane=drec.BasePlane, XSize=cluster, YSize=cluster_2, Radius=0)  # -> Rectangle, Length
mplane = MeshPlane(Boundary=rectangle.Rectangle, WidthCount="1", HeightCount="1")  # -> Mesh, Area; disabled
R = ClusterOutput(rectangle.Rectangle)
move = Move(Geometry=rectangle.Rectangle, Motion=amp)  # -> Geometry, Transform
boxrec = BoxRectangle(Rectangle=move.Geometry, Height="0.040")
mbox = MeshBox(Base=boxrec, XCount="1", YCount="1", ZCount="1")
M = ClusterOutput(mbox)

# ==== cluster Cluster_4
num = ClusterInput()
num_2 = ClusterInput()
int = ClusterInput()
num_3 = Number(num)
number_slider = MargeX(num_3)
num_4 = Number(num_2)
int_2 = Integer(int)
A = ClusterInput()
division = Division(A=A, B=num_2)
A_2 = ClusterInput()
division_2 = Division(A=number_slider, B=num_4)
division_3 = Division(A=A, B=int_2)
division_4 = Division(A=int_2, B=division)
subtraction = Subtraction(A=division_3, B=number_slider, C=number_slider)
multiplication = Multiplication(A=division_2, B=division_4)
A_3 = ClusterInput()
N = ClusterInput()
subtraction_2 = Subtraction(A=int_2, B=1)
min = Minimum(A=A_2, B=subtraction)
div = DivideDomain(Domain=division, Count=int_2)
range = Range(Domain=subtraction_2, Steps=subtraction_2)
margex = Data(multiplication)
addition = Addition(A=A_3, B=range)
max = Maximum(A=min, B=num_4)
random = Random(Range=Domain(0, 1), Number=N, Seed=addition)
division_5 = Division(A=max, B=num_4)
random_2 = Random(Range=Domain(0, 1), Number=N, Seed=addition)
multiplication_2 = Multiplication(A=division_5, B=division_4)
randomness = ClusterInput()
random_3 = Random(Range=Domain(0, 1), Number=1, Seed=2)
expression = Expression(
    margeX=margex,
    rand=random,
    minWidth=multiplication_2,
    randomness=randomness,
    Expression="margeX + rand*(1-2*margeX - minWidth)*randomness")
max_2 = Maximum(A=expression, B=margex)
expression_2 = Expression(
    margeX=margex,
    rand=random_2,
    randx=max_2,
    minWidth=multiplication_2,
    randomness=randomness,
    Expression="1-margeX - rand*(1-randx-margeX-minWidth)*randomness")
flip = FlipMatrix(Data=max_2)
flip_2 = FlipMatrix(Data=expression_2)
remap = RemapNumbers(Value=flip, Source=Domain(0, 1), Target=div)  # -> Mapped, Clipped
panel = Panel(remap.Mapped)
remap_2 = RemapNumbers(Value=flip_2, Source=Domain(0, 1), Target=div)  # -> Mapped, Clipped
flip_3 = FlipMatrix(Data=remap_2.Mapped)  # -> graft(Data)
flip_4 = FlipMatrix(Data=remap.Mapped)  # -> graft(Data)
int_3 = Integer(division)
round = Round(Number=flip_3)  # -> Nearest, Floor, Ceiling
merge = Merge(Data1=flip_4, Data2=round.Floor)
int_4 = Integer(merge)
division_6 = Division(A=int_4, B=int_3)
int_5 = ClusterOutput(int_3)
R = ClusterOutput(division_6)
panel_2 = Panel(int_4)

# ==== cluster Cluster_6
tailley = ClusterInput()
row = ClusterInput()
margeinf = ClusterInput()
margesup = ClusterInput()
num = Number(margeinf)
num_2 = Number(tailley)
division = Division(A="2", B=tailley)
number_slider = MargeX(num)
int = Integer(row)
A = ClusterInput()
division_2 = Division(A=A, B=tailley)
int_2 = Integer(division)
int_3 = Integer(division_2)
division_3 = Division(A=int_3, B=int)
minopeningheight = ClusterInput()
division_4 = Division(A=A, B=int)
subtraction = Subtraction(A=division_4, B=number_slider, C=number_slider)
division_5 = Division(A=int_2, B=division_3)
cluster = Cluster_5(A=margesup, B=num_2, A_2=int, B_2=int_3)  # -> margex_2, R
cluster_2 = Cluster_5(A=number_slider, B=num_2, A_2=int, B_2=int_3)  # -> margex_2, R
subtraction_2 = Subtraction(A=int, B=1)
A_2 = ClusterInput()
N = ClusterInput()
min = Minimum(A=minopeningheight, B=subtraction)
range = Range(Domain=subtraction_2, Steps=subtraction_2)
div = DivideDomain(Domain=int_3, Count=int)
addition = Addition(A=A_2, B=range)
max = Maximum(A=min, B=num_2)
addition_2 = Addition(A=addition, B=range)
division_6 = Division(A=max, B=num_2)
random = Random(Range=Domain(0, 1), Number=N, Seed=addition)
random_2 = Random(Range=Domain(0, 1), Number=N, Seed=addition_2)
multiplication = Multiplication(A=division_6, B=cluster_2.R)
randomness = ClusterInput()
random_3 = Random(Range=Domain(0, 1), Number=1, Seed=2)
expression = Expression(
    margeX=cluster_2.margex_2,
    rand=random,
    minWidth=multiplication,
    randomness=randomness,
    Expression="margeX + rand*(1-2*margeX - minWidth)*randomness")
N_2 = ClusterInput()
B = ClusterInput()
panel = Panel("1")
max_2 = Maximum(A=expression, B=cluster_2.margex_2)
split = SplitTree(Data=max_2, Masks=flatten("{0;0;0}"))  # -> Positive, Negative
lng = ListLength(List=split.Positive)
subtraction_3 = Subtraction(A=lng, B=B)
remap = RemapNumbers(Value=subtraction_3, Source=lng, Target=lng)  # -> Mapped, Clipped
reduce = RandomReduce(List=split.Positive, Reduction=remap.Clipped, Seed=A_2)
index = ItemIndex(List=split.Positive, Item=reduce)
replace = ReplaceItems(List=split.Positive, Item="0", Indices=index, Wrap=False)
pshift = ShiftPaths(Data=replace, Offset="-2")
merge = Merge(Data1=pshift, Data2=split.Negative)
expression_2 = Expression(
    margeX=cluster.margex_2,
    rand=random_2,
    randx=merge,
    minWidth=multiplication,
    randomness=randomness,
    Expression="1-margeX - rand*(1-randx-margeX-minWidth)*randomness")
flip = FlipMatrix(Data=merge)
remap_2 = RemapNumbers(Value=flip, Source=Domain(0, 1), Target=div)  # -> Mapped, Clipped
split_2 = SplitTree(Data=expression_2, Masks=flatten("{0;0;0}"))  # -> Positive, Negative
replace_2 = ReplaceItems(List=split_2.Positive, Item=division_5, Indices=index, Wrap=False)
pshift_2 = ShiftPaths(Data=replace_2, Offset="-2")
max_3 = Maximum(A=split_2.Positive, B=pshift_2)
division_7 = Division(A=A, B=tailley)
merge_2 = Merge(Data1=max_3, Data2=split_2.Negative)
flip_2 = FlipMatrix(Data=merge_2)
remap_3 = RemapNumbers(Value=flip_2, Source=Domain(0, 1), Target=div)  # -> Mapped, Clipped
merge_3 = Merge(Data1=graft(remap_2.Mapped), Data2=graft(remap_3.Mapped))
int_4 = Integer(merge_3)
int_5 = Integer(division_7)
division_8 = Division(A=int_4, B=int_5)
int_6 = ClusterOutput(int_5)
R = ClusterOutput(division_8)

# ==== cluster Cluster_7
S = ClusterInput()
C = ClusterInput()
srfcenter = SurfaceCenter(Surface=S)  # -> Center, Normal, Frame
bbox = BoundingBox(Content=C, Plane=srfcenter.Frame)  # -> Box, Box_2
debox = DeconstructBox(Box=bbox.Box_2)  # -> Plane, X, Y, Z
objdet = ObjectDetails(Object=S)  # -> Referenced, Available, Name, Layer, Colour, Guid
num = Number(debox.X)
num_2 = Number(debox.Y)
num_3 = ClusterOutput(num)
num_4 = ClusterOutput(num_2)

# ==== cluster Cluster_8
B = ClusterInput()
edges = BrepEdges(Brep=B)  # -> Naked, Interior, NonManifold
item = ListItem(List=edges.Naked, Index=0, Wrap=True)  # -> Item, Item1, Item2, Item3
P = ClusterInput()
flip = FlipCurve(Curve=item.Item1)  # -> Curve, Flag
merge = Merge(Data1=item.Item, Data2=flip.Curve)  # -> flatten(Result)
ext = ExtendCurve(Curve=merge, Type=0, Start="-0.015", End="0")
pull = PullPoint(Point=P, Geometry=ext, ClosestOnly=True)  # -> ClosestPoint, Distance
larger = LargerThan(FirstNumber=pull.Distance, SecondNumber="0.01")  # -> LargerThan, OrEqualTo
pt = ConstructPoint(XCoordinate=0, YCoordinate=0, ZCoordinate=0)
sift = SiftPattern(List=P, SiftPattern=larger.LargerThan)  # -> Output0, Output1
nullrep = ReplaceNulls(Items=sift.Output0, Replacements=pt)  # -> Items, Count
I = ClusterOutput(nullrep.Items)

# ==== cluster Cluster_2
I = ClusterInput()
num = ClusterInput()
dedomain = DeconstructDomain(Domain=I)  # -> Start, End
num_2 = Number(num)
addition = Addition(A=dedomain.Start, B=num_2)
subtraction = Subtraction(A=dedomain.End, B=num_2)
dom = ConstructDomain(DomainStart=addition, DomainEnd=subtraction)
I_2 = ClusterOutput(dom)

# ==== cluster Cluster_5
A = ClusterInput()
B = ClusterInput()
A_2 = ClusterInput()
B_2 = ClusterInput()
division = Division(A=A, B=B)
division_2 = Division(A=A_2, B=B_2)
R = ClusterOutput(division_2)
multiplication = Multiplication(A=division, B=division_2)
margex = Data(multiplication)
margex_2 = ClusterOutput(margex)
