# Grasshopper definition HybridImplementation.gh (Grasshopper 1.0.7)
# plug-ins: Pufferfish, Kangaroo2 Components, HFTidyCanvas, Human UI, MetaHopper

panel = Panel("""TODO: 
Bouton Bake?""")
pipeline = GeometryPipeline(
    GroupByLayer=False,
    GroupByType=False,
    IncludeHidden=True,
    IncludeLocked=True,
    LayerFilter="Hybrid::input",
    NameFilter="*",
    SublayerFiltering=True,
    TypeFilter=1073741848)
srf = Surface(pipeline)
srf_2 = Surface(srf)
cluster = Cluster_7(S=srf_2)  # -> x, y, F, num_3, num_4

variation_parement = Slider(66, range=0..105)
objfromgroup = GetObjectsInGroup()

button = Button()

variation_baies = Slider(23, range=0..105)
objfromgroup_2 = GetObjectsInGroup()

multy = Slider(2, range=1..6)
objfromgroup_3 = GetObjectsInGroup()

portes = Slider(4, range=0..5)
objfromgroup_4 = GetObjectsInGroup()

rangées = Slider(3, range=1..5)
objfromgroup_5 = GetObjectsInGroup()

hauteur = Slider(1.62, range=0.4..2.5)
objfromgroup_6 = GetObjectsInGroup()

largeur = Slider(1.98, range=0.4..2.4)
objfromgroup_7 = GetObjectsInGroup()

multx = Slider(3, range=1..6)
objfromgroup_8 = GetObjectsInGroup()

randomness = Slider(0.86, range=0..1)
objfromgroup_9 = GetObjectsInGroup()

objfromgroup_10 = GetObjectsInGroup()
colonnes = Slider(4, range=0..6)

button_2 = CreateButton(ButtonName="reset", ButtonStyle=0)
panel_2 = Panel("0.1")
values = ValueListener(Elements=button_2, SomeProperty=True)  # -> Values, Indices

slider = CreateSlider(Slider=multy, ShowBounds=False, ShowTicks=False, ShowTooltip=False, ShowValLabel=True, showLabel=True)
values_2 = ValueListener(Elements=slider, SomeProperty=True)  # -> Values, Indices
dam = DataDam(DataA=values_2.Values, BufferDelay=5000000, BufferMode=2)
setobj = SetObjectValue(ObjectToSet=objfromgroup_3, ValueToSet=dam)

slider_2 = CreateSlider(Slider=multx, ShowBounds=False, ShowTicks=False, ShowTooltip=False, ShowValLabel=True, showLabel=True)
values_3 = ValueListener(Elements=slider_2, SomeProperty=True)  # -> Values, Indices
dam_2 = DataDam(DataA=values_3.Values, BufferDelay=5000000, BufferMode=2)
setobj_2 = SetObjectValue(ObjectToSet=objfromgroup_8, ValueToSet=dam_2)

slider_3 = CreateSlider(Slider=variation_baies, ShowBounds=False, ShowTicks=False, ShowTooltip=False, ShowValLabel=True, showLabel=True)
values_4 = ValueListener(Elements=slider_3, SomeProperty=True)  # -> Values, Indices
dam_3 = DataDam(DataA=values_4.Values, BufferDelay=5000000, BufferMode=2)
setobj_3 = SetObjectValue(ObjectToSet=objfromgroup_2, ValueToSet=dam_3)

slider_4 = CreateSlider(Slider=variation_parement, ShowBounds=False, ShowTicks=False, ShowTooltip=False, ShowValLabel=True, showLabel=True)
values_5 = ValueListener(Elements=slider_4, SomeProperty=True)  # -> Values, Indices
dam_4 = DataDam(DataA=values_5.Values, BufferDelay=5000000, BufferMode=2)
setobj_4 = SetObjectValue(ObjectToSet=objfromgroup, ValueToSet=dam_4)

slider_5 = CreateSlider(Slider=portes, ShowBounds=False, ShowTicks=False, ShowTooltip=False, ShowValLabel=True, showLabel=True)
values_6 = ValueListener(Elements=slider_5, SomeProperty=True)  # -> Values, Indices
dam_5 = DataDam(DataA=values_6.Values, BufferDelay=5000000, BufferMode=2)
setobj_5 = SetObjectValue(ObjectToSet=objfromgroup_4, ValueToSet=dam_5)

slider_6 = CreateSlider(Slider=rangées, ShowBounds=False, ShowTicks=False, ShowTooltip=False, ShowValLabel=True, showLabel=True)
values_7 = ValueListener(Elements=slider_6, SomeProperty=True)  # -> Values, Indices
dam_6 = DataDam(DataA=values_7.Values, BufferDelay=5000000, BufferMode=2)
setobj_6 = SetObjectValue(ObjectToSet=objfromgroup_5, ValueToSet=dam_6)

slider_7 = CreateSlider(Slider=colonnes, ShowBounds=False, ShowTicks=False, ShowTooltip=False, ShowValLabel=True, showLabel=True)
values_8 = ValueListener(Elements=slider_7, SomeProperty=True)  # -> Values, Indices
dam_7 = DataDam(DataA=values_8.Values, BufferDelay=5000000, BufferMode=2)
setobj_7 = SetObjectValue(ObjectToSet=objfromgroup_10, ValueToSet=dam_7)

slider_8 = CreateSlider(Slider=hauteur, ShowBounds=False, ShowTicks=False, ShowTooltip=False, ShowValLabel=True, showLabel=True)
values_9 = ValueListener(Elements=slider_8, SomeProperty=True)  # -> Values, Indices
dam_8 = DataDam(DataA=values_9.Values, BufferDelay=5000000, BufferMode=2)
setobj_8 = SetObjectValue(ObjectToSet=objfromgroup_6, ValueToSet=dam_8)

slider_9 = CreateSlider(Slider=randomness, ShowBounds=False, ShowTicks=False, ShowTooltip=False, ShowValLabel=True, showLabel=True)
values_10 = ValueListener(Elements=slider_9, SomeProperty=True)  # -> Values, Indices
dam_9 = DataDam(DataA=values_10.Values, BufferDelay=5000000, BufferMode=2)
setobj_9 = SetObjectValue(ObjectToSet=objfromgroup_9, ValueToSet=dam_9)

slider_10 = CreateSlider(Slider=largeur, ShowBounds=False, ShowTicks=False, ShowTooltip=False, ShowValLabel=True, showLabel=True)
values_11 = ValueListener(Elements=slider_10, SomeProperty=True)  # -> Values, Indices
dam_10 = DataDam(DataA=values_11.Values, BufferDelay=5000000, BufferMode=2)
setobj_10 = SetObjectValue(ObjectToSet=objfromgroup_7, ValueToSet=dam_10)

button_3 = Button(values.Values)
getscreen = GetScreenDimensions()  # -> Width, Height
border = CreateBorder(BorderThickness=5, BorderColor=RGB(0, 0, 0), CornerRadius=0)
launchxpwin = LaunchTransparentWindow(
    Show=Toggle(True),
    Name="Control Window",
    Width=Slider(256, range=50..450),
    Height=Slider(459, range=50..550),
    ChildStatus=1,
    EnableHorizScroll=True)
pt = ConstructPoint(XCoordinate=Slider(67, range=50..150), YCoordinate=Slider(201, range=50..450), ZCoordinate=0)
winprops = SetWindowProperties(
    Window=launchxpwin,
    StartingLocation=pt,
    ShowTitleBar=Toggle(False),
    BackgroundColor=ColourSwatch(SwatchColor=RGBA(255, 255, 255, 46)),
    ScaleFactor=1)
adjustpos = AdjustElementPositioning(AbsolutePositioning=False)
merge = Merge(
    Data1=slider_9,
    Data2=slider_2,
    Data3=slider,
    Data4=slider_10,
    Data5=slider_8,
    Data6=slider_6,
    Data7=slider_7,
    Data8=slider_5,
    Data9=slider_3,
    Data10=slider_4,
    Data11=button_2)
addelems = AddElements(Window=launchxpwin, Elements=flatten(merge), DoVLChecking=True)  # -> AddedElements, ElementNames
int = Integer(rangées)
int_2 = Integer(colonnes)
rangées_2 = Rangées(int)
randomness_2 = Randomness(randomness)
number_slider = TrameHorizontale(int_2)
variation_baies_2 = VariationBaies(variation_baies)
relay = DataDescription(srf_2)
multiplication = Multiplication(A="5", B="0.001")
brep = Brep(pipeline)
objdet = ObjectDetails(Object=brep)  # -> Referenced, Available, Name, Layer, Colour, Guid
concat = Concatenate(FragmentA="2.", FragmentB=objdet.Name)

line = Line(cluster.y)
end = EndPoints(Curve=line)  # -> Start, End
ext = ExtendCurve(Curve=line, Type=0, Start="-0.2", End="-0.2")
offset = OffsetCurve(Curve=line, Distance="0.1", Plane=cluster.F, Corners=1)
grab = Grab(On=True, Strength=1, Range="0.5")
oncurve = OnCurve(Points=end.Start, Curve=ext, Strength="10")
solver = Solver(GoalObjects=flatten([grab, oncurve]), Reset=button_3, Threshold=1e-07, Tolerance=0.0001, On=True)  # -> I, V, O
dist = Distance(PointA=solver.V, PointB=end.Start)
sph = Sphere(Base=solver.V, Radius="0.05")
crv_cp = CurveClosestPoint(Point=solver.V, Curve=offset)  # -> Point, Parameter, Distance
pl_origin = PlaneOrigin(Base=cluster.F, Origin=solver.V)
pl_origin_2 = PlaneOrigin(Base=cluster.F, Origin=crv_cp.Point)
roundd = RoundToDecimalPlace(NumberX=dist, DecimalPlace="2", RoundType=0)  # -> Rounded, Difference
rounded = DataDescription(roundd.Rounded)

prot = RotatePlane(Plane=pl_origin_2, Angle="Pi/2")
prot_2 = RotatePlane(Plane=pl_origin, Angle="Pi/2")

panel_3 = Panel(roundd.Rounded)

tag = TextTag3D(Location=prot_2, Text=" TailleY", Size="0.3", Justification=7)
tag_2 = TextTag3D(Location=prot, Text=rounded, Size="0.3", Justification=2)

dam_11 = DataDam(DataA=rounded, BufferDelay=2500000, BufferMode=2)

offset_2 = OffsetCurve(Curve=line, Distance=1, Plane=cluster.F, Corners=1)
line_2 = Line(offset_2)
end_2 = EndPoints(Curve=line_2)  # -> Start, End
ext_2 = ExtendCurve(Curve=line_2, Type=0, Start="-0.2", End="-0.2")
offset_3 = OffsetCurve(Curve=line_2, Distance="0.1", Plane=cluster.F, Corners=1)
grab_2 = Grab(On=True, Strength=1, Range="0.2")
oncurve_2 = OnCurve(Points=[end_2.Start, end_2.End], Curve=ext_2, Strength="100")
midpt = CurveMiddle(Curve=line_2)
solver_2 = Solver(GoalObjects=flatten([grab_2, oncurve_2]), Reset=button_3, Threshold=1e-07, Tolerance=0.0001, On=True)  # -> I, V, O
dist_2 = Distance(PointA=solver_2.V, PointB=[end_2.Start, end_2.End])
sph_2 = Sphere(Base=solver_2.V, Radius="0.05")
crv_cp_2 = CurveClosestPoint(Point=solver_2.V, Curve=offset_3)  # -> Point, Parameter, Distance
pl_origin_3 = PlaneOrigin(Base=cluster.F, Origin=midpt)
pl_origin_4 = PlaneOrigin(Base=cluster.F, Origin=crv_cp_2.Point)
roundd_2 = RoundToDecimalPlace(NumberX=dist_2, DecimalPlace="2", RoundType=0)  # -> Rounded, Difference
prot_3 = RotatePlane(Plane=pl_origin_4, Angle="Pi/2")
prot_4 = RotatePlane(Plane=pl_origin_3, Angle="Pi/2")
rounded_2 = DataDescription(roundd_2.Rounded)
tag_3 = TextTag3D(Location=prot_4, Text="Marge", Size="0.3", Justification=2)
tag_4 = TextTag3D(Location=prot_3, Text=rounded_2, Size="0.3", Justification=2)

dam_12 = DataDam(DataA=rounded_2, BufferDelay=2500000, BufferMode=2)

item = ListItem(List=dam_12, Index=0, Wrap=True)  # -> Item, Item1

line_3 = Line(cluster.x)
ext_3 = ExtendCurve(Curve=line_3, Type=0, Start="-0.2", End="-0.2")
end_3 = EndPoints(Curve=line_3)  # -> Start, End
offset_4 = OffsetCurve(Curve=line_3, Distance="0.1", Plane=cluster.F, Corners=1)
oncurve_3 = OnCurve(Points=end_3.Start, Curve=ext_3, Strength="10")
grab_3 = Grab(On=True, Strength=1, Range="0.5")
solver_3 = Solver(GoalObjects=flatten([grab_3, oncurve_3]), Reset=button_3, Threshold=1e-07, Tolerance=0.0001, On=True)  # -> I, V, O
crv_cp_3 = CurveClosestPoint(Point=solver_3.V, Curve=offset_4)  # -> Point, Parameter, Distance
pl_origin_5 = PlaneOrigin(Base=cluster.F, Origin=solver_3.V)
pl_origin_6 = PlaneOrigin(Base=cluster.F, Origin=crv_cp_3.Point)
tag_5 = TextTag3D(Location=pl_origin_5, Text=" TailleX  ", Size="0.3", Justification=7)

offset_5 = OffsetCurve(Curve=line_3, Distance=1, Plane=cluster.F, Corners=1)
line_4 = Line(offset_5)
offset_6 = OffsetCurve(Curve=line_4, Distance="0.1", Plane=cluster.F, Corners=1)
ext_4 = ExtendCurve(Curve=line_4, Type=0, Start="-0.2", End="-0.2")
end_4 = EndPoints(Curve=line_4)  # -> Start, End
grab_4 = Grab(On=True, Strength=1, Range="0.2")
oncurve_4 = OnCurve(Points=end_4.Start, Curve=ext_4, Strength="10")
solver_4 = Solver(GoalObjects=flatten([grab_4, oncurve_4]), Reset=button_3, Threshold=1e-07, Tolerance=0.0001, On=True)  # -> I, V, O
dist_3 = Distance(PointA=solver_4.V, PointB=end_4.Start)
sph_3 = Sphere(Base=solver_4.V, Radius="0.05")
crv_cp_4 = CurveClosestPoint(Point=solver_4.V, Curve=offset_6)  # -> Point, Parameter, Distance
pl_origin_7 = PlaneOrigin(Base=cluster.F, Origin=crv_cp_4.Point)
pl_origin_8 = PlaneOrigin(Base=cluster.F, Origin=solver_4.V)
roundd_3 = RoundToDecimalPlace(NumberX=dist_3, DecimalPlace="2", RoundType=0)  # -> Rounded, Difference
rounded_3 = DataDescription(roundd_3.Rounded)
tag_6 = TextTag3D(Location=pl_origin_8, Text=" Marge  ", Size="0.3", Justification=7)
tag_7 = TextTag3D(Location=pl_origin_7, Text=rounded_3, Size="0.3", Justification=1)

crv_cp_5 = CurveClosestPoint(Point=solver_3.V, Curve=ext_3)  # -> Point, Parameter, Distance
dam_13 = DataDam(DataA=rounded_3, BufferDelay=2500000, BufferMode=2)

sph_4 = Sphere(Base=crv_cp_5.Point, Radius="0.05")
dist_4 = Distance(PointA=crv_cp_5.Point, PointB=end_3.Start)
roundd_4 = RoundToDecimalPlace(NumberX=dist_4, DecimalPlace="2", RoundType=0)  # -> Rounded, Difference
tag_8 = TextTag3D(Location=pl_origin_6, Text=roundd_4.Rounded, Size="0.3", Justification=1)

dam_14 = DataDam(DataA=roundd_4.Rounded, BufferDelay=2500000, BufferMode=2)
rounded_4 = DataDescription(dam_14)

rounded_5 = Rounded(rounded_4)

number_slider_2 = Slider(0.32, range=0.1..1)
number_slider_3 = Slider(0.32, range=0.1..1)
rounded_6 = Panel(rounded_5)
panel_4 = Panel(dam_11)
rounded_7 = Number(rounded_6)
taille_y = Number(panel_4)

cluster_2 = Cluster_6(
    tailley=taille_y,
    minopeningheight=hauteur,
    margeinf=item.Item,
    margesup=item.Item1,
    randomness=flatten(randomness_2),
    suirify_7=number_slider,
    row=rangées_2,
    suirify_8=variation_baies_2,
    suirify=cluster.num_4,
    N=1,
    B=portes)  # -> R, int_6
cluster_3 = Cluster_4(
    suirify_9=largeur,
    suirify=dam_13,
    suirify_15=flatten(randomness_2),
    suirify_3=number_slider,
    suirify_12=rangées_2,
    suirify_10=variation_baies_2,
    suirify_2=rounded_7,
    suirify_6=cluster.num_3)  # -> R, int_4
bnd = Bounds(Numbers=cluster_3.R)
bnd_2 = Bounds(Numbers=cluster_2.R)
dom² = ConstructDomain²(DomainU=bnd, DomainV=bnd_2)
subsrf = Isotrim(Surface=reparameterize(relay), Domain=dom²)

sdivide = DivideSurface(Surface=relay, UCount=expr("x*2", cluster_3.int_4), VCount=expr("x*2", cluster_2.int_6))  # -> Points, Normals, Parameters
panel_5 = Panel(cluster_3.R)
clean = CleanTree(RemoveNulls=True, RemoveInvalid=True, RemoveEmpty=True, Tree=subsrf)

runion = RegionUnion(Curves=flatten(clean))
rdiff = RegionDifference(CurvesA=relay, CurvesB=flatten(runion))
boundary = BoundarySurfaces(Edges=flatten(rdiff))
shrinktrimsrf = ShrinkTrimmedSurface(Surface=boundary)  # -> Shrunken, Underlying, R

variation_façade = Slider(20, range=0..20)
genpoints = CSharpScript(Srf=shrinktrimsrf.Shrunken, U=cluster_3.int_4, V=cluster_2.int_6)  # -> out, xsrfPt, srfPt, plane; inputs Srf: Brep, U: Int32, V: Int32
# ---------- genpoints: C# ----------
    Plane plane = new Plane();
    Surface FlatSrf = (Surface) Srf.Faces[0];
    // DataTree<Point3d>
    FlatSrf.FrameAt(0.5, 0.5, out plane);
    //FlatSrf.
    var newSrf = (Rhino.Geometry.Surface) FlatSrf.DuplicateShallow();
    //newSrf = Srf;
    DataTree<Point3d> srfPt = new DataTree<Point3d>();
    DataTree<Point3d> xsrfPt = new DataTree<Point3d>();
    List<Point3d> closestPt = new List<Point3d>();
    Rhino.Geometry.Interval intervalU = new Rhino.Geometry.Interval(0, 2 * U);
    Rhino.Geometry.Interval intervalV = new Rhino.Geometry.Interval(0, 2 * V);
    newSrf.SetDomain(0, intervalU);
    newSrf.SetDomain(1, intervalV);
    //test line
    Point3d nulPoint3d = new Point3d(0, 0, 0);
    for (int i = 0; i < (2 * U) + 1; i++)
    {
      GH_Path ghPath = new GH_Path(0, i);
      for (int j = 0; j < (2 * V) + 1;j++)
      {
        Point3d newPt;
        newPt = newSrf.PointAt(i, j);
        srfPt.Add(newPt, ghPath);
        double srfU = new double();
        double srfV = new double();
        FlatSrf.ClosestPoint(newPt, out srfU, out srfV);
        if (Srf.Faces[0].IsPointOnFace(srfU, srfV) == 0)
        {
          xsrfPt.Add(newPt, ghPath);
        }
        else
        {
          xsrfPt.Add(nulPoint3d, ghPath);
        }

      }
    }
    _xsrfPt = xsrfPt;
    _srfPt = srfPt;
    _plane = plane;
# ---------- end genpoints ----------

rec = Rectangle(clean)
incurves = PointInCurves(Point=sdivide.Points, Curves=flatten(rec))  # -> Relationship, Index, Point
sift = SiftPattern(List=sdivide.Points, SiftPattern=incurves.Relationship)  # -> Output0, Output1, Output2
cluster_4 = Cluster_8(B=rec, L=sift.Output1, P=sift.Output1)
c_script = CSharpScript(iPoints=sdivide.Points, ExPoints=sift.Output2, Openingpts=cluster_4, MaxX=multx, MaxY=multy, seed=variation_parement)  # -> out, A, B; inputs iPoints: tree of Point3d, ExPoints: tree of Point3d, Openingpts: tree of Point3d, MaxX: Int32, MaxY: Int32, seed: Int32
# ---------- c_script: C# usings ----------
using System.Linq;
# ---------- c_script: C# ----------
    List<Rectangle3d> claddingrects = new List<Rectangle3d>();
    _seed = seed;
    _maxY = MaxX;
    _maxX = MaxY;

    List < List < Point3d >> pts = new List<List<Point3d>>();
    List<List<Point3d>> xpts = new List<List<Point3d>>();
    List<List<Point3d>> openingpts = new List<List<Point3d>>();
    for (int i = 0;i < iPoints.BranchCount ; i++)
    {
      pts.Add(iPoints.Branch(i));
      xpts.Add(ExPoints.Branch(i));
      openingpts.Add(Openingpts.Branch(i));
    }
    Cladding(pts, xpts, openingpts, Nul, _seed, _maxX, _maxY, out claddingrects);
    A = claddingrects;
    //B = b;
  }
  private static List<int> _indexList = new List<int>();
  private static int _seed;
  private static int _maxX;
  private static int _maxY;
  public static List<Point3d> b;
  public static Plane Pln = new Plane();
  public static Point3d Nul = new Point3d(0, 0, 0);
  public static void Cladding(List < List < Point3d >> iPoints, List<List<Point3d>> exPoints, List<List < Point3d >> openingPts, Point3d nullPoint, int seed, int maxX, int maxY, out List<Rectangle3d> claddingRects)
  {
    _indexList.Clear();
    _maxX = maxX;
    List<List<Point3d>> pts = new List<List<Point3d>>();
    pts.AddRange(iPoints);
    b = new List<Point3d>();
    List<List<Point3d>> xPts = new List<List<Point3d>>();
    xPts.AddRange(exPoints);
    Nul = nullPoint;
    _seed = seed;
    for (var i = 0; i < iPoints.Count - 1; i++) //Pts
    {
      for (var j = 0; j < iPoints[i].Count - 1;j++)
      {
        if ((exPoints[i][j].Equals(Nul)))// | )
        {
          if (((i % 2) == 0) && ((j % 2) == 0))
          {
            _indexList.Add((i * 1000 + j));
            b.Add(iPoints[i][j]);
          }
        }
        if ((openingPts[i][j] != Nul))// | )
        {
          if (((i % 2) == 0) && ((j % 2) == 0))
          {
            if (_indexList.Contains(i * 1000 + j))
              _indexList.Remove((i * 1000 + j));
          }
        }
      }
    }

    List<Rectangle3d> oRect = new List<Rectangle3d>();
    oRect.Clear();
    _maxY = maxY;
    for (int j = maxX, i = maxY, m = i * j; m > 1; )
    {
      Rectangle(i * 2, j * 2, ref pts, ref xPts, ref oRect, ref _indexList);
      if (i > 1)
        Rectangle((i - 1) * 2, j * 2, ref pts, ref xPts, ref oRect, ref _indexList);
      if (j > 1)
        Rectangle(i * 2, (j - 1) * 2, ref pts, ref xPts, ref oRect, ref _indexList);
      if (i > 1)
        --i;
      if (j > 1)
        --j;
      m = i * j;
    }
    foreach (var id in _indexList)
    {
      int id1 = id / 1000;
      int id2 = id - id1 * 1000;
      Plane rPlane = new Plane(pts[id1 + 2][id2], pts[id1][id2], pts[id1 + 2][id2 + 2]);
      var rec = new Rectangle3d(rPlane, pts[id1][id2], pts[id1 + 2][id2 + 2]);
      oRect.Add(rec);
    }
    claddingRects = oRect;
  }
  private static Rectangle3d CheckRectangle(int x, int y, int[] index, List<List < Point3d >> pts, ref List<List<Point3d>> xPts, ref int iter, ref List<int> indexList, ref List<int> tempList)
  {
    var insidePtsIdx = InsidePts(x, y, index);
    var perimeterIdx = PerimeterPts(x, y, index);
    bool test = false;
    Rectangle3d rect = new Rectangle3d();
    foreach (List<int> idx in perimeterIdx)
    {
      Point3d inPt = xPts[idx[0]][idx[1]];
      test = !(inPt.Equals(Nul));
      if (!test) continue;
      foreach (var removeId in from idx2 in perimeterIdx where idx2[0] % 2 == 0 && idx2[1] % 2 == 0 select idx2[0] * 1000 + idx2[1])
      {
        if (tempList.Contains(removeId))
        {tempList.Remove(removeId);}
      }
      break;
    }
    if (!test)
    {
      foreach (List<int> idx in insidePtsIdx)
      {
        var inPt = xPts[idx[0]][idx[1]];
        test = !(inPt.Equals(Nul));
        if (test)
        {
          if (tempList.Contains(idx[0] * 1000 + idx[1]))
            tempList.Remove(idx[0] * 1000 + idx[1]);
          break;
        }
      }
    }
    if (test)
    {
      iter++;
    }
    else
    {
      Point3d cptA = pts[index[0]][index[1]];
      Point3d cptB = pts[(index[0] + x)][(index[1] + y)];
      var cptC = pts[index[0]][index[1] + y];
      var plane = new Plane(cptC, cptA, cptB);
      if (cptA != cptB)
      {
        Rectangle3d r = new Rectangle3d(plane, cptA, cptB);
        rect = r;
      }
      for (int i = 1; i < (x) ;i++)//Left column
      {
        List<int> idx = new List<int>
          {
            index[0] + i,
            index[1]
            };
        if ((idx[0] % 2 == 0) && (idx[1] % 2 == 0))
        {
          indexList.Remove(idx[0] * 1000 + idx[1]);
          tempList.Remove(idx[0] * 1000 + idx[1]);

        }
      }
      for (int i = 1; i < (y) ;i++)//Bottom Row
      {
        List<int> idx = new List<int>
          {
            index[0],
            index[1] + i
            };
        if ((idx[0] % 2 == 0) && (idx[1] % 2 == 0))
        {
          indexList.Remove(idx[0] * 1000 + idx[1]);
          tempList.Remove(idx[0] * 1000 + idx[1]);

        }
      }
      foreach (List<int> idx in insidePtsIdx)
      {
        if ((idx[0] % 2 == 0) && (idx[1] % 2 == 0))
        {
          indexList.Remove(idx[0] * 1000 + idx[1]);
          tempList.Remove(idx[0] * 1000 + idx[1]);
        }
        xPts[idx[0]][idx[1]] = pts[idx[0]][idx[1]];
      }
    }
    return rect;
  }
  private static List<List<int>> InsidePts(int x, int y, IReadOnlyList<int> index)
  {
    List<List<int>> insidePtsIndex = new List<List<int>>();
    for (int i = 1; i < x;i++)
    {

      for (int j = 1;j < y;j++)
      {

        List<int> idx = new List<int>
          {
            index[0] + i,
            index[1] + j
            };
        insidePtsIndex.Add(idx);
      }
    }
    return insidePtsIndex;
  }
  private static List<List<int>> PerimeterPts(int x, int y, IReadOnlyList<int> index)
  {
    List<List<int>> insidePointsIndex = new List<List<int>>();
    for (var i = 0; i < (x + 1) ;i++) //left column
    {
      List<int> idx = new List<int>
        {
          index[0] + i,
          index[1]
          };
      insidePointsIndex.Add(idx);
    }
    for (int i = 0; i < (x + 1);i++) //right column
    {
      List<int> idx = new List<int>
        {
          index[0] + i,
          index[1] + y
          };
      insidePointsIndex.Add(idx);
    }
    for (var i = 1; i < y;i++)  // Bottom row
    {
      List<int> idx = new List<int>
        {
          index[0],
          index[1] + i
          };
      insidePointsIndex.Add(idx);
    }
    for (var i = 1; i < y ;i++) // Top row
    {
      List<int> idx = new List<int>
        {
          index[0] + x,
          index[1] + i
          };
      insidePointsIndex.Add(idx);
    }

    return insidePointsIndex;
  }
  private static void Rectangle (int i, int j, ref List<List<Point3d>> pts, ref List<List<Point3d>> xPts, ref List<Rectangle3d> oRect, ref List<int> indexList)
  {
    int iteration = 0;
    List<int> tempList = new List<int>();
    var x = pts[0].Count;
    var y = pts.Count;
    tempList.AddRange(indexList);
    var rand = new Random(_seed);
    int listLength = tempList.Count;
    while ((listLength > i*j*2))
    {
      int idx = rand.Next(((y - i) / 2) + 1) * 2;
      int idy = rand.Next(((x - j) / 2) + 1) * 2;
      var temp = (idx * 1000) + idy;
      if (tempList.Contains(temp))
        tempList.Remove(temp);
      int id1 = idx;
      int id2 = idy;
      int[] index = {id1,id2};
      Rectangle3d rect = CheckRectangle(i, j, index, pts, ref xPts, ref iteration, ref indexList, ref tempList);
      if (rect.Height > 0)
      {
        indexList.Remove(temp);
        //TODO maybe remove points from temp list that cant be in: -i left and -j under
        oRect.Add(rect);
      }
      _seed++;
      listLength = tempList.Count;
    }
# ---------- end c_script ----------
panel_6 = Panel(subsrf)
cluster_5 = Cluster_3(C=c_script.A, num=multiplication)  # -> M, R
srf_3 = Surface(shrinktrimsrf.Shrunken)

variation_couleur = Slider(0, range=0..9)
trim = TrimTree(Tree=cluster_5.M, Depth=1)
cluster_6 = Cluster(
    d1=ColourSwatch(SwatchColor=RGB(178, 131, 107)),
    d2=ColourSwatch(SwatchColor=RGB(222, 170, 131)),
    L=trim,
    S=variation_couleur)  # -> R, D

range = Range(Domain=cluster.num_4, Steps=rangées_2)
pt_2 = ConstructPoint(XCoordinate=0, YCoordinate=0, ZCoordinate=range)
baies = WindowDoorGen(iCrv=rec, projectionPlane=pt_2, maxWidth="1500")  # -> out, Script, A, Doors, Doorframes, Windows, Windowframes, Glass; inputs iCrv: tree of Rectangle3d, refPt: tree of Point3d, projectionPlane: list of Plane, maxWidth: Double
# ---------- baies: C# usings ----------
using System.Linq;
using System.Linq.Expressions;
using Rhino.Geometry.Collections;
# ---------- baies: C# ----------
    UnitConverter();
    doors.Clear();
    innerframecrv.Clear();
    windows.Clear();
    doorframes.Clear();
    borderCurveList.Clear();
    maxDoorWidth = maxWidth * unitConverter;
    windowFrames.Clear();
    glass.Clear();
    List<double> levelHeight = new List<double>();
    foreach (var plane in projectionPlane)
    {
      double planeHeight = plane.OriginZ;
      levelHeight.Add(planeHeight);
    }

    levelHeight.Sort();
    //unitConverter = 1;

    DataTree<Rectangle3d> sortedRects = new DataTree<Rectangle3d>();
    TreeIteration(iCrv, levelHeight, sortedRects);

    //A = Rhino.RhinoDoc.ActiveDoc.ModelUnitSystem.GetHashCode();
    A = unitConverter;
    Doors = doors;
    Doorframes = doorframes;
    Windows = windows;
    Windowframes = windowFrames;
    Glass = glass;
    //Clear trees

  }

  private static void TreeIteration(DataTree<Rectangle3d> iCrv, List<double> levelHeight, DataTree<Rectangle3d> sortedRects)
  {
    for (int i = 0; i < iCrv.BranchCount; i++)
    {
      var ghPaths = GhPaths(iCrv, levelHeight, i);
      BranchIteration(iCrv, i, levelHeight, sortedRects, ghPaths);
    }
  }

  private static void BranchIteration(DataTree<Rectangle3d> iCrv, int i, List<double> levelHeight, DataTree<Rectangle3d> sortedRects, List<GH_Path> ghPaths)
  {
    foreach (Rectangle3d crv in iCrv.Branch(i))
    {
      double rectCenterZ = crv.Center.Z;
      LevelIteration(levelHeight, rectCenterZ, crv, sortedRects, ghPaths);
    }
  }

  private static void LevelIteration(List<double> levelHeight, double rectCenterZ, Rectangle3d crv,
    DataTree<Rectangle3d> sortedRects, List<GH_Path> ghPaths)
  {
    for (int k = 1; k < levelHeight.Count; k++)
    {
      if (LevelSeparation(levelHeight, rectCenterZ, crv, sortedRects, ghPaths, k)) break;
    }
  }

  private static bool LevelSeparation(List<double> levelHeight, double rectCenterZ, Rectangle3d crv, DataTree<Rectangle3d> sortedRects,
    List<GH_Path> ghPaths, int k)
  {
    if (levelHeight[k] > rectCenterZ)
    {
      WindowDoorSeparation(crv, levelHeight, k, sortedRects, ghPaths);
      return true;
    }

    return false;
  }

  private static void WindowDoorSeparation(Rectangle3d crv, List<double> levelHeight, int k,
    DataTree<Rectangle3d> sortedRects, List<GH_Path> ghPaths)
  {

    if (crv.BoundingBox.Min.Z > levelHeight[k - 1] + 20 * unitConverter)
    {
      Window(crv, k, sortedRects, ghPaths);
    }
    else
    {
      Door(crv, k, sortedRects, ghPaths);
    }
  }

  private static void Door(Rectangle3d crv, int k, DataTree<Rectangle3d> sortedRects, List<GH_Path> ghPaths)
  {
    GH_Path doorpath = ghPaths[k - 1].AppendElement(1);
    sortedRects.Add(crv, doorpath);
    List<Rectangle3d> doorBoundaries = new List<Rectangle3d>();
    RectReorientation(ref crv);
    var borderSurfaces = BorderSurfaces(crv, 50, 70);
    foreach (var borderSurface in borderSurfaces)
    {
      doorframes.Add(borderSurface, doorpath);

    }

    List<bool> split = new List<bool>();
    RectSplit(crv, doorBoundaries, split);
    for (var index = 0; index < doorBoundaries.Count; index++)
    {
      Rectangle3d doorcrv = doorBoundaries[index];
      List<Brep> portes;
      Surface vitrage;
      //Brep doorFrame;


      PorteInd(doorcrv, split[index], 50, 0, 50, 800, 50, out portes, out vitrage);
      foreach (var porte in portes)
      {
        doors.Add(porte, doorpath);
      }
      glass.Add(vitrage, doorpath);

    }
    //Porte(crv, out cadre, out portes, out vitrage, out doorCrv);
  }

  private static void Window(Rectangle3d crv, int k, DataTree<Rectangle3d> sortedRects, List<GH_Path> ghPaths)
  {
    GH_Path windowpath = ghPaths[k - 1].AppendElement(0);
    sortedRects.Add(crv, windowpath);
    //List<Rectangle3d> doorBoundaries = new List<Rectangle3d>();
    RectReorientation(ref crv);

    Rectangle3d doorcrv = crv;
    List<Brep> fenetres;
    Surface vitrage;
    List<Brep> windowFrame;
    Surface dumpSurface;
    PorteInd(doorcrv, false, 0, 0, 80, 80, 80, out windowFrame, out dumpSurface);
    PorteInd(doorcrv, false, 80, 80, 50, 50, 50, out fenetres, out vitrage);
    foreach (var fenetre in fenetres)
    {
      windows.Add(fenetre, windowpath);
    }
    glass.Add(vitrage, windowpath);
    foreach (var windowframe in windowFrame)
    {
      windowFrames.Add(windowframe, windowpath);
    }



  }
  private static List<GH_Path> GhPaths(DataTree<Rectangle3d> iCrv, List<double> levelHeight, int i)
  {
    List<GH_Path> ghPaths = new List<GH_Path>();
    for (int j = 0; j < levelHeight.Count; j++)
    {
      ghPaths.Add(iCrv.Paths[i].AppendElement(j));
    }

    return ghPaths;
  }
  private static void UnitConverter()
  {
    var unitSystem = Rhino.RhinoDoc.ActiveDoc.ModelUnitSystem;
    var unitSystemHashCode = unitSystem.GetHashCode();
    switch (unitSystemHashCode)
    {
      case 2:
        unitConverter = 1;
        break;
      case 3:
        unitConverter = 0.1;
        break;
      case 4:
        unitConverter = 0.001;
        break;
    }

  }
  private static void PorteInd(Rectangle3d doorcrv, bool split, double a, double b, double c, double d, double thickness, out List<Brep> porte, out Surface vitrage)
  {
    double e = a;
    if (split)
    {
      e = 0;
    }
    var outerFrame = OffsetRectangle(doorcrv, a, b, e);
    var innerFrame = OffsetRectangle(outerFrame, c, d, c);
    vitrage = new PlaneSurface(innerFrame.Plane, innerFrame.X, innerFrame.Y);

    var door = BrepOffset(outerFrame, innerFrame, thickness);

    porte = door;
    //borderCurveList.Add(borderCurve[0].ToNurbsCurve());
  }

  private static List<Brep> BorderSurfaces (Rectangle3d doorcrv, double a, double c)
  {
    List<Line> borderCurve = Border(doorcrv);
    var outerFrame = OffsetRectangle(doorcrv, a, 0, a);
    List<Line> innerBorderCurve = Border(outerFrame);
    List<Brep> borderSurfaces = new List<Brep>();
    for (var index = 0; index < borderCurve.Count; index++)
    {
      var outerLine = borderCurve[index].ToNurbsCurve();
      var innerLine = innerBorderCurve[index].ToNurbsCurve();
      Surface borderSurface = NurbsSurface.CreateRuledSurface(outerLine, innerLine);
      Brep borderBrep = Brep.CreateFromOffsetFace(borderSurface.ToBrep().Faces[0], c * unitConverter, 0.1 * unitConverter, true, true);
      borderSurfaces.Add(borderBrep);
    }

    return borderSurfaces;
  }

  private static List<Brep> BrepOffset(Rectangle3d outerFrame, Rectangle3d innerFrame, double a)
  {
    var outerFramelines = outerFrame.ToPolyline().GetSegments();
    var innerFramelines = innerFrame.ToPolyline().GetSegments();
    List<Brep> doorList = new List<Brep>();
    for (int i = 0; i < outerFramelines.Length; i++)
    {
      var doorBorder = NurbsSurface.CreateRuledSurface(outerFramelines[i].ToNurbsCurve(), innerFramelines[i].ToNurbsCurve()).ToBrep();
      Brep door = Brep.CreateFromOffsetFace(doorBorder.Faces[0], a * unitConverter, 0.1, true, true);
      doorList.Add(door);
    }
    return doorList;
  }

  private static List<Line> Border(Rectangle3d doorcrv)
  {
    var polyline = doorcrv.ToPolyline();
    var exploded = polyline.GetSegments();
    List<Line> border = new List<Line>();
    foreach (var line in exploded)
    {
      var mid = (line.From + line.To) / 2;
      if (mid.Z > polyline.BoundingBox.Min.Z + 5 * unitConverter)
      {
        border.Add(line);
      }
    }

    //border.ToNurbsCurve();
    return border;
  }

  private static Rectangle3d OffsetRectangle(Rectangle3d doorcrv, double a, double b, double c)
  {
    Interval intervalX = new Interval(doorcrv.X.Min + a * unitConverter, doorcrv.X.Max - c * unitConverter);
    Interval intervalY = new Interval(doorcrv.Y.Min + b * unitConverter, doorcrv.Y.Max - a * unitConverter);
    Rectangle3d offsetRectangle = new Rectangle3d(doorcrv.Plane, intervalX, intervalY);
    return offsetRectangle;
  }

  private static void RectReorientation(ref Rectangle3d crv)
  {
    Interval intervalX;
    Interval intervalY;
    Plane plane;
    RectOrientation(crv, out intervalX, out intervalY, out plane);
    //intervalY.Swap();
    crv = new Rectangle3d(plane, intervalX, intervalY);
  }

  private static void RectSplit(Rectangle3d crv, List<Rectangle3d> doorBoundaries, List<bool>split)
  {
    if (crv.Width > maxDoorWidth)
    {
      var doorBoundary1 = new Rectangle3d(crv.Plane, new Interval(crv.X.T0, crv.X.Mid), new Interval(crv.Y));
      doorBoundaries.Add(doorBoundary1);
      split.Add(true);
      var xDirection = crv.Plane.XAxis;
      xDirection.Reverse();
      var plane = new Plane(crv.Plane.Origin, xDirection, crv.Plane.YAxis);
      //plane.
      var doorBoundary2 = new Rectangle3d(plane, new Interval(-crv.X.Mid, -crv.X.T1), new Interval(crv.Y));
      doorBoundaries.Add(doorBoundary2);
      split.Add(true);
      return;
    }
    doorBoundaries.Add(crv);
    split.Add(false);
  }
  private static void RectOrientation(Rectangle3d crv, out Interval intervalX, out Interval intervalY, out Plane plane)
  {
    //Plane plane;
    if (crv.Plane.YAxis.IsParallelTo(Vector3d.ZAxis, Math.PI / 4) == 1)
    {
      intervalX = new Interval(crv.X);
      intervalY = new Interval(crv.Y);
      plane = crv.Plane;
    }
    else
    {
      intervalX = new Interval(crv.Y);
      intervalY = new Interval(crv.X);
      plane = crv.Plane;
      plane.Rotate(Math.PI / 2, plane.ZAxis);
      var testorient = plane.YAxis;
      testorient.Unitize();
      //if (testorient.Z == -1)
      //intervalY.Swap();


    }
# ---------- baies: C# additional code ----------
  public static double unitConverter;
  public static List<Rectangle3d> innerframecrv = new List<Rectangle3d>();
  public static double maxDoorWidth;
  public static DataTree<Surface> glass = new DataTree<Surface>();
  public static DataTree<Brep> windows = new DataTree<Brep>();
  public static DataTree<Brep> doors = new DataTree<Brep>();
  public static DataTree<Brep> doorframes = new DataTree<Brep>();
  public static List<Curve> borderCurveList = new List<Curve>();
  public static DataTree<Brep> windowFrames = new DataTree<Brep>();
# ---------- end baies ----------

preview = CustomPreview(Geometry=cluster_6.R, Material=cluster_6.D)
preview_2 = CustomPreview(
    Geometry=[baies.Doors, baies.Doorframes, baies.Windowframes, baies.Windows],
    Material=ColourSwatch(SwatchColor=RGB(168, 108, 77)))
c_script_2 = CSharpScript(
    TileXSize=rounded_7,
    TileYSize=taille_y,
    variability=randomness,
    columns=colonnes,
    rows=rangées,
    MaxX=multx,
    MaxY=multy,
    seed=variation_parement,
    SeedB=variation_baies,
    MargeX=dam_13,
    UpperMargin=item.Item1,
    LowerMargin=item.Item,
    MinOpeningHeight=hauteur,
    MinOpeningWidth=largeur,
    DoorNumber=portes,
    Name=concat)  # -> out, A; inputs TileXSize: Double, TileYSize: Double, variability: Double, columns: Double, rows: Double, MaxX: Double, MaxY: Double, seed: Double, SeedB: Double, MargeX: Double, UpperMargin: Double, LowerMargin: Double, MinOpeningHeight: Double, MinOpeningWidth: Double, DoorNumber: Double, Name: String
# ---------- c_script_2: C# usings ----------
using System.IO;
# ---------- c_script_2: C# ----------
    if (Name != _oldName)
      _oldParameters.Clear();
    if (Name != null)
    {
      var rhinoPath = RhinoDoc.ActiveDoc.Path;
      var rhinoName = RhinoDoc.ActiveDoc.Name;
      rhinoPath = rhinoPath.TrimEnd(rhinoName.ToCharArray());
      //rhinoName = rhinoName.TrimEnd(".3dm".ToCharArray());
      rhinoName = rhinoName.Substring(0, rhinoName.Length - 4);
      //RhinoApp.WriteLine(rhinoPath);
      rhinoPath += rhinoName + ".csv";
      if (!File.Exists(rhinoPath))
      {
        string headers = "Time;" + "Object;" + "TileXSize;" + "TileYSize;" + "Variability;" + "Columns;" + "Rows;" +
          "MultipleX;" + "MultipleY;" + "CladdingSeed;" + "OpeningSeed;" + "MargeX;" + "UpperMargin;" +
          "LowerMargin;" + "MinOpeningHeight;" + "MinOpeningWidth;" + "DoorNumber;" + "\n";
        File.AppendAllText(rhinoPath, headers);


      }
      var now = System.DateTime.Now;
      var test = now.Hour + ":" + now.Minute + ":" + now.Second + ":" + now.Millisecond + ";";

      List<double> parameters = new List<double>
        {
          TileXSize, TileYSize, _variability, _columns, _rows, MaxX, MaxY, _seed, SeedB, MargeX, UpperMargin, LowerMargin,
          MinOpeningHeight, MinOpeningWidth,DoorNumber
          };
      if (_oldParameters.Count > 0)
      {
        int check = 1;
        for (var i = 0; i < parameters.Count; i++)
        {
          if (Math.Abs(parameters[i] - _oldParameters[i]) > 0.01)
            check = 0;
        }
        if (check == 1)
        {
          A = "skipped";
          return;
        }
      }

      test += Name + ";";
      _oldParameters.Clear();
      foreach (var parameter in parameters)
      {
        _oldParameters.Add(parameter);
        test += (parameter.ToString()) + ";";
      }
      test += "\n";
      _oldName = Name;
      File.AppendAllText(rhinoPath, test);
      A = "written";
    }
# ---------- c_script_2: C# additional code ----------
  private static List<double> _oldParameters = new List<double>();
  private static string _oldName = "";
# ---------- end c_script_2 ----------
panel_7 = Panel(c_script_2.A)

# ==== cluster Cluster
L = ClusterInput()
S = ClusterInput()
jitter = Jitter(List=L, Jitter=1, Seed=S)  # -> Values, Indices
python = GhPythonScript(x=jitter.Values)  # -> out, a, b, c, d; inputs x: list of Curve; disabled
# ---------- python: Python ----------
__author__ = "Xavier"
__version__ = "2020.03.22"

import rhinoscriptsyntax as rs
import ghpythonlib.components as ghpc

i=1

a=x
a=ghpc.Dispatch(a,[True,False])
#e,f=ghpc.Dispatch(a,[True,False])
#c,d=ghpc.Dispatch(f,[True,False])
#a,b=ghpc.Dispatch(e,[True,False])
def disp(a,l,i):
    if i==l:
        return a
    else:
        b=[]
        for z in range(i):
            print(type(z))
            c,d=ghpc.Dispatch(a[z],[True,False])
            b.append(c)
            b.append(d)
            #print(type(d))
            #b.insert(d,int(2*z))
            #b.insert(e,2*z+1)
        a=b
        i=i+1
        return disp(a,l,i)
a=disp(a,2,i)
#    b=ghpc.Dispatch(b,[True,False])
#    for c in b:
#        c=ghpc.Dispatch(c,[True,False])
# ---------- end python ----------
dispatch = Dispatch(List=jitter.Values, DispatchPattern=[True, False])  # -> ListA, ListB
jitter_2 = Jitter(List=dispatch.ListB, Jitter=1, Seed=2)  # -> Values, Indices
jitter_3 = Jitter(List=dispatch.ListA, Jitter=1, Seed=2)  # -> Values, Indices
d1 = ClusterInput()
d2 = ClusterInput()
dispatch_2 = Dispatch(List=jitter_2.Values, DispatchPattern=[True, False])  # -> ListA, ListB
dispatch_3 = Dispatch(List=jitter_3.Values, DispatchPattern=[True, False])  # -> ListA, ListB
range = Range(Domain=Domain(0, 1), Steps=Slider(7, range=0..10))
merge = Merge(Data1=d1, Data2=d2)
dispatch_4 = Dispatch(List=dispatch_3.ListB, DispatchPattern=[True, False])  # -> ListA, ListB
dispatch_5 = Dispatch(List=dispatch_3.ListA, DispatchPattern=[True, False])  # -> ListA, ListB
dispatch_6 = Dispatch(List=dispatch_2.ListB, DispatchPattern=[True, False])  # -> ListA, ListB
dispatch_7 = Dispatch(List=dispatch_2.ListA, DispatchPattern=[True, False])  # -> ListA, ListB
twnthrucols = TweenThroughColors(Colors=merge, Factor=range, Normalized=True, Equalized=False, Weighted=False, Degree=3, InterpolationType=0, Alpha=True)
entwine = Entwine(
    Branch00=dispatch_5.ListA,
    Branch01=dispatch_5.ListB,
    Branch02=dispatch_4.ListA,
    Branch03=dispatch_4.ListB,
    Branch04=dispatch_7.ListA,
    Branch05=dispatch_7.ListB,
    Branch06=dispatch_6.ListA,
    Branch07=dispatch_6.ListB,
    FlattenInputs=True)
pshift = ShiftPaths(Data=twnthrucols, Offset="-2")  # -> graft(Data)
srf = Surface()
R = ClusterOutput(entwine)
D = ClusterOutput(pshift)

# ==== cluster Cluster_3
num = ClusterInput()
C = ClusterInput()
num_2 = Number(num)
flip = FlipCurve(Curve=C)  # -> Curve, Flag
drec = DeconstuctRectangle(Rectangle=flip.Curve)  # -> BasePlane, XInterval, YInterval
deplane = DeconstructPlane(Plane=drec.BasePlane)  # -> Origin, XAxis, YAxis, ZAxis
cluster = Cluster_2(I=drec.XInterval, num=num_2)
cluster_2 = Cluster_2(I=drec.YInterval, num=num_2)
amp = Amplitude(Vector=deplane.ZAxis, Amplitude="-0.020")
rectangle = Rectangle(Plane=drec.BasePlane, XSize=cluster, YSize=cluster_2, Radius=0)  # -> Rectangle, Length
mplane = MeshPlane(Boundary=rectangle.Rectangle, WidthCount="1", HeightCount="1")  # -> Mesh, Area; disabled
R = ClusterOutput(rectangle.Rectangle)
move = Move(Geometry=rectangle.Rectangle, Motion=amp)  # -> Geometry, Transform
boxrec = BoxRectangle(Rectangle=move.Geometry, Height="0.040")
mbox = MeshBox(Base=boxrec, XCount="1", YCount="1", ZCount="1")
M = ClusterOutput(mbox)

# ==== cluster Cluster_4
suirify = ClusterInput()
suirify_2 = ClusterInput()
suirify_3 = ClusterInput()
suirify_4 = Suirify(suirify)
suirify_5 = Suirify(suirify_3)
suirify_6 = ClusterInput()
suirify_7 = Suirify(suirify_2)
num = Number(suirify_4)
number_slider = MargeX(num)
num_2 = Number(suirify_7)
suirify_8 = Suirify(suirify_6)
int = Integer(suirify_5)
division = Division(A=suirify_8, B=suirify_7)
suirify_9 = ClusterInput()
division_2 = Division(A=number_slider, B=num_2)
division_3 = Division(A=suirify_8, B=int)
division_4 = Division(A=int, B=division)
subtraction = Subtraction(A=division_3, B=number_slider, C=number_slider)
suirify_10 = ClusterInput()
multiplication = Multiplication(A=division_2, B=division_4)
subtraction_2 = Subtraction(A=int, B=1)
suirify_11 = Suirify(suirify_9)
suirify_12 = ClusterInput()
min = Minimum(A=suirify_11, B=subtraction)
div = DivideDomain(Domain=division, Count=int)
range = Range(Domain=subtraction_2, Steps=subtraction_2)
margex = Data(multiplication)
suirify_13 = Suirify(suirify_10)
suirify_14 = Suirify(suirify_12)
max = Maximum(A=min, B=num_2)
addition = Addition(A=range, B=1)
addition_2 = Addition(A=suirify_13, B=addition)
addition_3 = Addition(A=addition_2, B=1)
division_5 = Division(A=max, B=num_2)
random = Random(Range=Domain(0, 1), Number=suirify_14, Seed=addition_2)
random_2 = Random(Range=Domain(0, 1), Number=suirify_14, Seed=addition_3)
suirify_15 = ClusterInput()
multiplication_2 = Multiplication(A=division_5, B=division_4)
random_3 = Random(Range=Domain(0, 1), Number=1, Seed=2)
suirify_16 = Suirify(suirify_15)
expression = Expression(
    margeX=margex,
    rand=random,
    minWidth=multiplication_2,
    randomness=suirify_16,
    Expression="margeX + rand*(1-2*margeX - minWidth)*randomness")
max_2 = Maximum(A=expression, B=margex)
expression_2 = Expression(
    margeX=margex,
    rand=random_2,
    randx=max_2,
    minWidth=multiplication_2,
    randomness=suirify_16,
    Expression="1-margeX - rand*(1-randx-margeX-minWidth)*randomness")
flip = FlipMatrix(Data=max_2)
flip_2 = FlipMatrix(Data=expression_2)
remap = RemapNumbers(Value=flip, Source=Domain(0, 1), Target=div)  # -> Mapped, Clipped
panel = Panel(remap.Mapped)
remap_2 = RemapNumbers(Value=flip_2, Source=Domain(0, 1), Target=div)  # -> Mapped, Clipped
flip_3 = FlipMatrix(Data=remap_2.Mapped)  # -> graft(Data)
flip_4 = FlipMatrix(Data=remap.Mapped)  # -> graft(Data)
int_2 = Integer(division)
round = Round(Number=flip_3)  # -> Nearest, Floor, Ceiling
round_2 = Round(Number=flip_4)  # -> Nearest, Floor, Ceiling
merge = Merge(Data1=round_2.Ceiling, Data2=round.Floor)
int_3 = Integer(merge)
division_6 = Division(A=int_3, B=int_2)
int_4 = ClusterOutput(int_2)
R = ClusterOutput(division_6)
panel_2 = Panel(int_3)

# ==== cluster Cluster_6
margeinf = ClusterInput()
row = ClusterInput()
tailley = ClusterInput()
suirify = ClusterInput()
margesup = ClusterInput()
suirify_2 = Suirify(tailley)
suirify_3 = Suirify(suirify)
suirify_4 = Suirify(row)
suirify_5 = Suirify(margeinf)
num = Number(suirify_5)
suirify_6 = Suirify(margesup)
panel = Panel(suirify_5)
num_2 = Number(suirify_2)
division = Division(A="2", B=suirify_2)
number_slider = MargeX(num)
int = Integer(suirify_4)
division_2 = Division(A=suirify_3, B=suirify_2)
int_2 = Integer(division)
int_3 = Integer(division_2)
division_3 = Division(A=int_3, B=int)
minopeningheight = ClusterInput()
division_4 = Division(A=suirify_3, B=int)
subtraction = Subtraction(A=division_4, B=number_slider, C=number_slider)
division_5 = Division(A=int_2, B=division_3)
cluster = Cluster_5(A=suirify_6, B=num_2, A_2=int, B_2=int_3)  # -> margex_2, R
cluster_2 = Cluster_5(A=number_slider, B=num_2, A_2=int, B_2=int_3)  # -> margex_2, R
suirify_7 = ClusterInput()
subtraction_2 = Subtraction(A=int, B=1)
suirify_8 = ClusterInput()
suirify_9 = Suirify(suirify_8)
suirify_10 = Suirify(minopeningheight)
min = Minimum(A=suirify_10, B=subtraction)
suirify_11 = Suirify(suirify_7)
range = Range(Domain=subtraction_2, Steps=subtraction_2)
div = DivideDomain(Domain=int_3, Count=int)
addition = Addition(A=suirify_9, B=range)
max = Maximum(A=min, B=num_2)
addition_2 = Addition(A=addition, B=range)
division_6 = Division(A=max, B=num_2)
random = Random(Range=Domain(0, 1), Number=suirify_11, Seed=addition)
random_2 = Random(Range=Domain(0, 1), Number=suirify_11, Seed=addition_2)
multiplication = Multiplication(A=division_6, B=cluster_2.R)
randomness = ClusterInput()
random_3 = Random(Range=Domain(0, 1), Number=1, Seed=2)
suirify_12 = Suirify(randomness)
panel_2 = Panel(suirify_12)
expression = Expression(
    margeX=cluster_2.margex_2,
    rand=random,
    minWidth=multiplication,
    randomness=suirify_12,
    Expression="margeX + rand*(1-2*margeX - minWidth)*randomness")
N = ClusterInput()
B = ClusterInput()
panel_3 = Panel("1")
max_2 = Maximum(A=expression, B=cluster_2.margex_2)
split = SplitTree(Data=max_2, Masks=flatten("{0;0;0}"))  # -> Positive, Negative
lng = ListLength(List=split.Positive)
subtraction_3 = Subtraction(A=lng, B=B)
remap = RemapNumbers(Value=subtraction_3, Source=lng, Target=lng)  # -> Mapped, Clipped
reduce = RandomReduce(List=split.Positive, Reduction=remap.Clipped, Seed=suirify_9)
index = ItemIndex(List=split.Positive, Item=reduce)
replace = ReplaceItems(List=split.Positive, Item="0", Indices=index, Wrap=False)
pshift = ShiftPaths(Data=replace, Offset="-2")
merge = Merge(Data1=pshift, Data2=split.Negative)
expression_2 = Expression(
    margeX=cluster.margex_2,
    rand=random_2,
    randx=merge,
    minWidth=multiplication,
    randomness=randomness,
    Expression="1-margeX - rand*(1-randx-margeX-minWidth)*randomness")
flip = FlipMatrix(Data=merge)
remap_2 = RemapNumbers(Value=flip, Source=Domain(0, 1), Target=div)  # -> Mapped, Clipped
split_2 = SplitTree(Data=expression_2, Masks=flatten("{0;0;0}"))  # -> Positive, Negative
replace_2 = ReplaceItems(List=split_2.Positive, Item=division_5, Indices=index, Wrap=False)
panel_4 = Panel(merge)
pshift_2 = ShiftPaths(Data=replace_2, Offset="-2")
max_3 = Maximum(A=split_2.Positive, B=pshift_2)
division_7 = Division(A=suirify_3, B=suirify_2)
round = Round(Number=remap_2.Mapped)  # -> Nearest, Floor, Ceiling
merge_2 = Merge(Data1=max_3, Data2=split_2.Negative)
flip_2 = FlipMatrix(Data=merge_2)
remap_3 = RemapNumbers(Value=flip_2, Source=Domain(0, 1), Target=div)  # -> Mapped, Clipped
round_2 = Round(Number=remap_3.Mapped)  # -> Nearest, Floor, Ceiling
merge_3 = Merge(Data1=graft(round.Ceiling), Data2=graft(round_2.Floor))
int_4 = Integer(merge_3)
int_5 = Integer(division_7)
division_8 = Division(A=int_4, B=int_5)
int_6 = ClusterOutput(int_5)
R = ClusterOutput(division_8)

# ==== cluster Cluster_7
S = ClusterInput()
srfcenter = SurfaceCenter(Surface=S)  # -> Center, Normal, Frame
bbox = BoundingBox(Content=S, Plane=srfcenter.Frame)  # -> Box, Box_2
edges = BrepEdges(Brep=bbox.Box)  # -> Naked, Interior, NonManifold
debox = DeconstructBox(Box=bbox.Box_2)  # -> Plane, X, Y, Z
item = ListItem(List=edges.Naked, Index=0, Wrap=True)  # -> Item, Item1
num = Number(debox.X)
num_2 = Number(debox.Y)
offset = OffsetCurve(Curve=item.Item, Distance="0.35", Plane=srfcenter.Frame, Corners=1)
num_3 = ClusterOutput(num)
num_4 = ClusterOutput(num_2)
offset_2 = OffsetCurve(Curve=item.Item1, Distance="0.35", Plane=srfcenter.Frame, Corners=1)
F = ClusterOutput(srfcenter.Frame)
x = ClusterOutput(offset)
y = ClusterOutput(offset_2)

# ==== cluster Cluster_8
B = ClusterInput()
edges = BrepEdges(Brep=B)  # -> Naked, Interior, NonManifold
item = ListItem(List=edges.Naked, Index=0, Wrap=True)  # -> Item, Item1, Item2, Item3
P = ClusterInput()
flip = FlipCurve(Curve=item.Item1)  # -> Curve, Flag
merge = Merge(Data1=item.Item, Data2=flip.Curve)  # -> flatten(Result)
L = ClusterInput()
ext = ExtendCurve(Curve=merge, Type=0, Start="-0.015", End="0")
pull = PullPoint(Point=P, Geometry=ext, ClosestOnly=True)  # -> ClosestPoint, Distance
larger = LargerThan(FirstNumber=pull.Distance, SecondNumber="0.01")  # -> LargerThan, OrEqualTo
pt = ConstructPoint(XCoordinate=0, YCoordinate=0, ZCoordinate=0)
sift = SiftPattern(List=L, SiftPattern=larger.LargerThan)  # -> Output0, Output1
nullrep = ReplaceNulls(Items=sift.Output0, Replacements=pt)  # -> Items, Count
I = ClusterOutput(nullrep.Items)

# ==== cluster Cluster_2
I = ClusterInput()
num = ClusterInput()
dedomain = DeconstructDomain(Domain=I)  # -> Start, End
num_2 = Number(num)
addition = Addition(A=dedomain.Start, B=num_2)
subtraction = Subtraction(A=dedomain.End, B=num_2)
dom = ConstructDomain(DomainStart=addition, DomainEnd=subtraction)
I_2 = ClusterOutput(dom)

# ==== cluster Cluster_5
A = ClusterInput()
B = ClusterInput()
A_2 = ClusterInput()
B_2 = ClusterInput()
division = Division(A=A, B=B)
division_2 = Division(A=A_2, B=B_2)
R = ClusterOutput(division_2)
multiplication = Multiplication(A=division, B=division_2)
margex = Data(multiplication)
margex_2 = ClusterOutput(margex)
